# Grasshopper definition 亭_偶数边形_案例.gh (Grasshopper 1.0.8)
# plug-ins: Moonlight, MyGrasshopperAssembly1

number_slider = Slider(5, range=1..11)
实际某六角亭 = Panel("1.1:1")
四五檩小式 = Panel("7:10")
六七檩小式 = Panel("8:10")
moonlight = Moonlight(Mode=Toggle(True))
circle = Circle(Plane=PlaneXY(0, 0, 0), Radius=Slider(1.7, range=0..10))
circle_2 = Circle(Plane=PlaneXY(0, 0, 0), Radius=Slider(1, range=0..10))

尺寸分析 = 尺寸分析(面阔="3.3", 柱高与面阔比=六七檩小式, 柱径与柱高比="1:11", 步架与柱径比="4:1")  # -> 柱高, 柱径, 步架

取竖段线_无斗拱亭子 = 取竖段线_无斗拱亭子(面阔="3.3", 柱高=尺寸分析.柱高, 多边形边数=Slider(8, range=0..10))  # -> 柱顶点, 竖段线, 柱底点
取横段线_无斗拱亭子 = 取横段线_无斗拱亭子(定位点=取竖段线_无斗拱亭子.柱顶点)

柱径d = Number(尺寸分析.柱径)
金盘 = Number("0.05")

檩径权衡_无斗拱亭子 = 檩径权衡_无斗拱亭子(檐柱径D=柱径d, 金盘一侧与半径比=金盘)
垫板高宽权衡_无斗拱亭子 = 垫板高宽权衡_无斗拱亭子(檐柱径D=柱径d)
枋高宽权衡_无斗拱亭子 = 枋高宽权衡_无斗拱亭子(檐柱径D=柱径d)  # -> 檐枋尺寸, 金脊枋尺寸, 穿插枋尺寸
number_slider_2 = Slider(0.2, range=0..0.3)
number_slider_3 = Slider(0.21, range=0..1)
deconstructsquareprofile = DeconstructSquareProfile(SquareProfile=垫板高宽权衡_无斗拱亭子, trueButton=1)  # -> Expansion0, Expansion1, Height, Width
deconstructcircularprofile = DeconstructCircularProfile(CircularProfile=檩径权衡_无斗拱亭子)  # -> Radius, JinPan
deconstructsquareprofile_2 = DeconstructSquareProfile(SquareProfile=枋高宽权衡_无斗拱亭子.檐枋尺寸, trueButton=0)  # -> Height, Width
gh_rectanglesection = GH_RectangleSection(
    定位基线=取横段线_无斗拱亭子,
    名称="檐枋",
    上浮中心下沉="下沉",
    偏移=Slider(0, range=0..100),
    开端出头=number_slider_2,
    尾端出头=number_slider_2,
    高=deconstructsquareprofile_2.Height,
    宽=deconstructsquareprofile_2.Width,
    改动基准=False)  # -> 图元信息, 顶部线, 中部线, 底部线
gh_rectanglesection_2 = GH_RectangleSection(
    定位基线=gh_rectanglesection.顶部线,
    名称="檐垫板",
    上浮中心下沉="上浮",
    偏移=Slider(0, range=0..100),
    开端出头=deconstructsquareprofile.Expansion0,
    尾端出头=deconstructsquareprofile.Expansion1,
    高=deconstructsquareprofile.Height,
    宽=deconstructsquareprofile.Width,
    改动基准=False)  # -> 图元信息, 顶部线, 中部线, 底部线
gh_circlesection = GH_CircleSection(
    定位基线=gh_rectanglesection_2.顶部线,
    名称="檐檩",
    上浮中心下沉="上浮",
    偏移=Slider(0, range=0..100),
    开端出头=number_slider_3,
    尾端出头=number_slider_3,
    半径=deconstructcircularprofile.Radius,
    金盘占比=deconstructcircularprofile.JinPan,
    改动基准=False)  # -> 图元信息, 顶部线, 中部线, 底部线
deconstructgeometryinformation = DeconstructGeometryInformation(GeometryInformation=gh_rectanglesection_2.图元信息)  # -> Brep, AnnotationGuideline, ReferencePlane, Description, BaseCurve
deconstructgeometryinformation_2 = DeconstructGeometryInformation(GeometryInformation=gh_circlesection.图元信息)  # -> Brep, AnnotationGuideline, ReferencePlane, Description, BaseCurve
deconstructgeometryinformation_3 = DeconstructGeometryInformation(GeometryInformation=gh_rectanglesection.图元信息)  # -> Brep, AnnotationGuideline, ReferencePlane, Description, BaseCurve
curve = Curve([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])
curve_2 = Curve([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])
curve_3 = Curve([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])
curve_4 = Curve(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)
entwine = Entwine(Branch00=curve_3, Branch01=curve, Branch02=curve_2, Branch03=curve_4, FlattenInputs=True)
number_slider_4 = Slider(0, range=0..100)
缩放 = 缩放(geometry=entwine, factor=Slider(0.689, range=0..1))  # -> curve_5, curve_6, curve_7, curve_8
柱径权衡_无斗拱亭子 = 柱径权衡_无斗拱亭子(檐柱径D=柱径d)  # -> 檐柱半径, 雷公柱半径

檐檩图元信息 = Data(gh_circlesection.图元信息)
檐檩顶部线 = Data(gh_circlesection.顶部线)

绘制挂落 = 绘制挂落(
    定位基线=gh_rectanglesection.底部线,
    柱径=柱径d,
    主体起始段=缩放.curve_5,
    主体中间段=缩放.curve_6,
    主体尾段=缩放.curve_7,
    边段=缩放.curve_8,
    主体宽=Slider(0.0124, range=0..0.02),
    边段宽=Slider(0.0203, range=0..0.03))  # -> 主体定位基面, 边段定位基面
gh_circlesection_2 = GH_CircleSection(
    定位基线=取竖段线_无斗拱亭子.竖段线,
    名称="檐柱",
    上浮中心下沉="中心",
    偏移=number_slider_4,
    开端出头=number_slider_4,
    尾端出头=number_slider_4,
    半径=柱径权衡_无斗拱亭子.檐柱半径,
    金盘占比=number_slider_4,
    改动基准=False)  # -> 图元信息, 顶部线, 中部线, 底部线
取横段线_无斗拱亭子_2 = 取横段线_无斗拱亭子(定位点=取竖段线_无斗拱亭子.柱底点)
取坐板_无斗拱亭子 = 取坐板_无斗拱亭子(
    定位基线=取横段线_无斗拱亭子_2,
    坐板宽=Slider(0.3, range=0..1),
    坐板外偏=Slider(0, range=0..1),
    端部坐板延申=Slider(0.1, range=0..1),
    移除第n项=Slider(1, range=0..10))
gh_face = GH_Face(定位基面=取坐板_无斗拱亭子, 名称="坐板", 上浮中心下沉="下沉", 偏移=Slider(0.66, range=0..2), 厚度=Slider(0.07, range=0..0.1))  # -> 图元信息, 顶部面, 中部面, 底部面
deconstructgeometryinformation_4 = DeconstructGeometryInformation(GeometryInformation=gh_circlesection_2.图元信息)  # -> Brep, AnnotationGuideline, ReferencePlane, Description, BaseCurve
deconstructgeometryinformation_5 = DeconstructGeometryInformation(GeometryInformation=gh_face.图元信息)  # -> Brep, AnnotationGuideline, ReferencePlane, Description, BaseCurve
deconstructbasecurve = DeconstructBaseCurve(BaseCurve=檐檩顶部线)  # -> Curve, ReferencePlane, Positive, ExtrudePlane

取步架_无斗拱亭子 = 取步架_无斗拱亭子(横段线=檐檩顶部线, 比例="2:2.5")  # -> 脊步架, 檐步架, 金檩横段线

取扒梁线_无斗拱亭子 = 取扒梁线_无斗拱亭子(檐檩横段线=檐檩顶部线, 金檩横段线=取步架_无斗拱亭子.金檩横段线, Data=Slider(0, range=0..10), LastLeft=0)  # -> 扒梁长段线, 扒梁短段线
gh_face_2 = GH_Face(定位基面=绘制挂落.主体定位基面, 名称="挂落主体", 上浮中心下沉="中心", 偏移=Slider(0, range=0..2), 厚度=Slider(0.02, range=0..0.1))  # -> 图元信息, 顶部面, 中部面, 底部面
gh_face_3 = GH_Face(定位基面=绘制挂落.边段定位基面, 名称="挂落边段", 上浮中心下沉="中心", 偏移=Slider(0, range=0..2), 厚度=Slider(0.04, range=0..0.1))  # -> 图元信息, 顶部面, 中部面, 底部面
取轴 = 取轴(定位基线=gh_circlesection_2.中部线)
檩径权衡_无斗拱亭子_2 = 檩径权衡_无斗拱亭子(檐柱径D=柱径d, 金盘一侧与半径比=金盘)
梁高宽权衡_无斗拱亭子 = 梁高宽权衡_无斗拱亭子(檐柱径D=柱径d)  # -> 长短扒梁半高差, 长扒梁, 短扒梁, 多边形扒梁
梁高宽权衡_无斗拱亭子_2 = 梁高宽权衡_无斗拱亭子(檐柱径D=柱径d)  # -> 长短扒梁半高差, 长扒梁, 短扒梁, 多边形扒梁
枋高宽权衡_无斗拱亭子_2 = 枋高宽权衡_无斗拱亭子(檐柱径D=柱径d)  # -> 檐枋尺寸, 金脊枋尺寸, 穿插枋尺寸
curve_5 = Curve(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)
deconstructgeometryinformation_6 = DeconstructGeometryInformation(GeometryInformation=gh_face_2.图元信息)  # -> Brep, AnnotationGuideline, ReferencePlane, Description, BaseCurve
deconstructgeometryinformation_7 = DeconstructGeometryInformation(GeometryInformation=gh_face_3.图元信息)  # -> Brep, AnnotationGuideline, ReferencePlane, Description, BaseCurve
number_slider_5 = Slider(0.31, range=0..0.5)
number_slider_6 = Slider(0, range=0..1)
deconstructbaseaxis = DeconstructBaseAxis(BaseAxis=取轴)  # -> AxisCurve, ReferencePlane, Positive
gh_revolution = GH_Revolution(定位轴=取轴, 名称="柱础", 偏移=Slider(0, range=0..100), 柱径D=柱径d, 旋转面=curve_5)
deconstructsquareprofile_3 = DeconstructSquareProfile(SquareProfile=梁高宽权衡_无斗拱亭子.长扒梁, trueButton=1)  # -> Expansion0, Expansion1, Height, Width
deconstructsquareprofile_4 = DeconstructSquareProfile(SquareProfile=梁高宽权衡_无斗拱亭子_2.短扒梁, trueButton=1)  # -> Expansion0, Expansion1, Height, Width
deconstructsquareprofile_5 = DeconstructSquareProfile(SquareProfile=枋高宽权衡_无斗拱亭子_2.金脊枋尺寸, trueButton=0)  # -> Height, Width
deconstructcircularprofile_2 = DeconstructCircularProfile(CircularProfile=檩径权衡_无斗拱亭子_2)  # -> Radius, JinPan
deconstructgeometryinformation_8 = DeconstructGeometryInformation(GeometryInformation=gh_revolution)  # -> Brep, AnnotationGuideline, ReferencePlane, Description, BaseCurve
gh_rectanglesection_3 = GH_RectangleSection(
    定位基线=取扒梁线_无斗拱亭子.扒梁长段线,
    名称="长扒梁",
    上浮中心下沉="中心",
    偏移=Slider(0, range=0..1),
    开端出头=deconstructsquareprofile_3.Expansion0,
    尾端出头=deconstructsquareprofile_3.Expansion1,
    高=deconstructsquareprofile_3.Height,
    宽=deconstructsquareprofile_3.Width,
    改动基准=False)  # -> 图元信息, 顶部线, 中部线, 底部线
gh_rectanglesection_4 = GH_RectangleSection(
    定位基线=取扒梁线_无斗拱亭子.扒梁短段线,
    名称="短扒梁",
    上浮中心下沉="中心",
    偏移=梁高宽权衡_无斗拱亭子_2.长短扒梁半高差,
    开端出头=deconstructsquareprofile_4.Expansion0,
    尾端出头=deconstructsquareprofile_4.Expansion1,
    高=deconstructsquareprofile_4.Height,
    宽=deconstructsquareprofile_4.Width,
    改动基准=False)  # -> 图元信息, 顶部线, 中部线, 底部线
取横段线中心平面_无斗拱亭子 = 取横段线中心平面_无斗拱亭子(定位基线=gh_rectanglesection_3.顶部线)
横段线投影_无斗拱亭子 = 横段线投影_无斗拱亭子(定位基线=取步架_无斗拱亭子.金檩横段线, 投影平面=取横段线中心平面_无斗拱亭子)
gh_rectanglesection_5 = GH_RectangleSection(
    定位基线=横段线投影_无斗拱亭子,
    名称="金枋",
    上浮中心下沉="上浮",
    偏移=Slider(0, range=0..100),
    开端出头=number_slider_5,
    尾端出头=number_slider_5,
    高=deconstructsquareprofile_5.Height,
    宽=deconstructsquareprofile_5.Width,
    改动基准=True)  # -> 图元信息, 顶部线, 中部线, 底部线
gh_circlesection_3 = GH_CircleSection(
    定位基线=gh_rectanglesection_5.顶部线,
    名称="金檩",
    上浮中心下沉="上浮",
    偏移=Slider(0, range=0..100),
    开端出头=number_slider_6,
    尾端出头=number_slider_6,
    半径=deconstructcircularprofile_2.Radius,
    金盘占比=deconstructcircularprofile_2.JinPan,
    改动基准=False)  # -> 图元信息, 顶部线, 中部线, 底部线
deconstructgeometryinformation_9 = DeconstructGeometryInformation(GeometryInformation=gh_circlesection_3.图元信息)  # -> Brep, AnnotationGuideline, ReferencePlane, Description, BaseCurve
deconstructgeometryinformation_10 = DeconstructGeometryInformation(GeometryInformation=gh_rectanglesection_5.图元信息)  # -> Brep, AnnotationGuideline, ReferencePlane, Description, BaseCurve
deconstructgeometryinformation_11 = DeconstructGeometryInformation(GeometryInformation=gh_rectanglesection_3.图元信息)  # -> Brep, AnnotationGuideline, ReferencePlane, Description, BaseCurve
deconstructgeometryinformation_12 = DeconstructGeometryInformation(GeometryInformation=gh_rectanglesection_4.图元信息)  # -> Brep, AnnotationGuideline, ReferencePlane, Description, BaseCurve

金檩图元信息 = Data(gh_circlesection_3.图元信息)
金檩顶部线 = Data(gh_circlesection_3.顶部线)

金枋底部线 = Data(gh_rectanglesection_5.底部线)

取举架_无斗拱亭子 = 取举架_无斗拱亭子(金檩顶定位基线=金檩顶部线, 檐檩顶定位基线=檐檩顶部线, 檐举架与脊举架比="1:2")  # -> 举架, 举架顶点

unit_z = UnitZ(Factor=Slider(0.05, range=0..0.3))
取横段内交线_无斗拱亭子 = 取横段内交线_无斗拱亭子(横段线=金檩顶部线)
deconstructbasecurve_2 = DeconstructBaseCurve(BaseCurve=取横段内交线_无斗拱亭子)  # -> Curve, ReferencePlane, Positive, ExtrudePlane
end_points = EndPoints(Curve=deconstructbasecurve_2.Curve)  # -> Start, End
move = Move(Geometry=end_points.Start, Motion=unit_z)  # -> Geometry, Transform
brep = Brep(deconstructgeometryinformation_11.Brep)
brep_2 = Brep(deconstructgeometryinformation_12.Brep)
brep_3 = Brep(deconstructgeometryinformation_4.Brep)
brep_4 = Brep(deconstructgeometryinformation_5.Brep)
brep_5 = Brep(deconstructgeometryinformation_9.Brep)
brep_6 = Brep(deconstructgeometryinformation_10.Brep)
brep_7 = Brep(deconstructgeometryinformation_3.Brep)
brep_8 = Brep(deconstructgeometryinformation_6.Brep)
brep_9 = Brep(deconstructgeometryinformation_7.Brep)
brep_10 = Brep(deconstructgeometryinformation_2.Brep)
brep_11 = Brep(deconstructgeometryinformation.Brep)
取戗线_无斗拱亭子 = 取戗线_无斗拱亭子(戗续点=move.Geometry, 举架顶点=取举架_无斗拱亭子.举架顶点)
brep_12 = Brep(deconstructgeometryinformation_8.Brep)
角梁高宽权衡_无斗拱亭子 = 角梁高宽权衡_无斗拱亭子(檐柱径D=柱径d)
number_slider_7 = Slider(0, range=0..100)
number_slider_8 = Slider(0, range=0..0.5)
柱径权衡_无斗拱亭子_2 = 柱径权衡_无斗拱亭子(檐柱径D=柱径d)  # -> 檐柱半径, 雷公柱半径
deconstructsquareprofile_6 = DeconstructSquareProfile(SquareProfile=角梁高宽权衡_无斗拱亭子, trueButton=0)  # -> Height, Width
deconstructsquareprofile_7 = DeconstructSquareProfile(SquareProfile=角梁高宽权衡_无斗拱亭子, trueButton=0)  # -> Height, Width
negative = Negative(Value=Slider(1.3, range=0..3))
取雷公柱线_小式亭子 = 取雷公柱线_小式亭子(举架顶点=取举架_无斗拱亭子.举架顶点, 举架顶点偏移=negative, 雷公柱高=Slider(2.1, range=0..3))
gh_circlesection_4 = GH_CircleSection(
    定位基线=取雷公柱线_小式亭子,
    名称="檐柱",
    上浮中心下沉="中心",
    偏移=number_slider_7,
    开端出头=number_slider_7,
    尾端出头=number_slider_7,
    半径=柱径权衡_无斗拱亭子_2.雷公柱半径,
    金盘占比=number_slider_7,
    改动基准=False)  # -> 图元信息, 顶部线, 中部线, 底部线
gh_rectanglesection_6 = GH_RectangleSection(
    定位基线=取戗线_无斗拱亭子,
    名称="戗",
    上浮中心下沉="中心",
    偏移=Slider(0, range=0..100),
    开端出头=number_slider_8,
    尾端出头=number_slider_8,
    高=Slider(0.136, range=0..0.2),
    宽=Slider(0.146, range=0..0.2),
    改动基准=True)  # -> 图元信息, 顶部线, 中部线, 底部线
取角梁线_无斗拱亭子 = 取角梁线_无斗拱亭子(金枋底定位基线=金枋底部线, 檐檩顶定位基线=檐檩顶部线, 檐檩顶下沉=Slider(0, range=0..0.3))
gh_rectanglesection_7 = GH_RectangleSection(
    定位基线=取角梁线_无斗拱亭子,
    名称="角梁",
    上浮中心下沉="上浮",
    偏移=Slider(0, range=0..1),
    开端出头=Slider(0.28, range=0..1),
    尾端出头=Slider(0.44, range=0..0.75),
    高=deconstructsquareprofile_7.Height,
    宽=deconstructsquareprofile_7.Width,
    改动基准=True)  # -> 图元信息, 顶部线, 中部线, 底部线
取仔角梁面_无斗拱亭子 = 取仔角梁面_无斗拱亭子(角梁顶部线=gh_rectanglesection_7.顶部线, 仔角梁平段出头=Slider(0.361, range=0..1), 仔角梁截面高=Slider(0.23, range=0..0.5))
gh_face_4 = GH_Face(定位基面=取仔角梁面_无斗拱亭子, 名称="仔角梁", 上浮中心下沉="中心", 偏移=Slider(0, range=0..1), 厚度=deconstructsquareprofile_6.Width)  # -> 图元信息, 顶部面, 中部面, 底部面
deconstructgeometryinformation_13 = DeconstructGeometryInformation(GeometryInformation=gh_face_4.图元信息)  # -> Brep, AnnotationGuideline, ReferencePlane, Description, BaseCurve
brep_13 = Brep(deconstructgeometryinformation_13.Brep)
deconstructgeometryinformation_14 = DeconstructGeometryInformation(GeometryInformation=gh_rectanglesection_7.图元信息)  # -> Brep, AnnotationGuideline, ReferencePlane, Description, BaseCurve
brep_14 = Brep(deconstructgeometryinformation_14.Brep)
deconstructgeometryinformation_15 = DeconstructGeometryInformation(GeometryInformation=gh_rectanglesection_6.图元信息)  # -> Brep, AnnotationGuideline, ReferencePlane, Description, BaseCurve
brep_15 = Brep(deconstructgeometryinformation_15.Brep)
deconstructgeometryinformation_16 = DeconstructGeometryInformation(GeometryInformation=gh_circlesection_4.图元信息)  # -> Brep, AnnotationGuideline, ReferencePlane, Description, BaseCurve
brep_16 = Brep(deconstructgeometryinformation_16.Brep)
仔角梁图元信息 = Data(gh_face_4.图元信息)
角梁图元信息 = Data(gh_rectanglesection_7.图元信息)

举架顶点 = Data(取举架_无斗拱亭子.举架顶点)
戗线 = Data(取戗线_无斗拱亭子)

取正身檐椽线_无斗拱亭子 = 取正身檐椽线_无斗拱亭子(金檩顶部线=金檩顶部线, 檐檩顶部线=檐檩顶部线, 金檩图元信息=金檩图元信息, 檐檩图元信息=檐檩图元信息, 椽间距=Slider(0.09, range=0..0.5), 出檐=Slider(0.26, range=0..1))  # -> 真实椽间距, 正身檐椽线
取正身椽线_无斗拱亭子 = 取正身椽线_无斗拱亭子(戗线=戗线, 举架顶点=举架顶点, 正身檐椽线=取正身檐椽线_无斗拱亭子.正身檐椽线)
椽半径 = Number(Slider(0.034, range=0..0.2))
number_slider_9 = Slider(0, range=0..1)
number_slider_10 = Slider(0, range=0..1)
number_slider_11 = Slider(0, range=0..1)
gh_circlesection_5 = GH_CircleSection(
    定位基线=取正身檐椽线_无斗拱亭子.正身檐椽线,
    名称="正身檐椽",
    上浮中心下沉="上浮",
    偏移=Slider(0, range=0..100),
    开端出头=number_slider_10,
    尾端出头=number_slider_10,
    半径=椽半径,
    金盘占比=0,
    改动基准=True)  # -> 图元信息, 顶部线, 中部线, 底部线
取翼角檐椽线_无斗拱亭子 = 取翼角檐椽线_无斗拱亭子(
    正身檐椽线=gh_circlesection_5.顶部线,
    角梁图元信息=角梁图元信息,
    曲线控制点位置=Slider(0.52, range=0..0.7),
    翼角檐椽间距=Slider(0.07, range=0..0.3),
    翼角檐椽顶间隔=Slider(0.102, range=0..0.2))  # -> 翼角檐椽线, 翼角檐椽尾曲线, 翼角檐椽顶线, 翼角曲线控制点, 翼角檐椽实际间距
gh_circlesection_6 = GH_CircleSection(
    定位基线=取翼角檐椽线_无斗拱亭子.翼角檐椽线,
    名称="翼角檐椽",
    上浮中心下沉="下沉",
    偏移=Slider(0, range=0..100),
    开端出头=number_slider_9,
    尾端出头=number_slider_9,
    半径=椽半径,
    金盘占比=0,
    改动基准=True)  # -> 图元信息, 顶部线, 中部线, 底部线
gh_circlesection_7 = GH_CircleSection(
    定位基线=取正身椽线_无斗拱亭子,
    名称="正身椽",
    上浮中心下沉="上浮",
    偏移=Slider(0, range=0..100),
    开端出头=number_slider_11,
    尾端出头=number_slider_11,
    半径=椽半径,
    金盘占比=0,
    改动基准=True)  # -> 图元信息, 顶部线, 中部线, 底部线
deconstructgeometryinformation_17 = DeconstructGeometryInformation(GeometryInformation=gh_circlesection_6.图元信息)  # -> Brep, AnnotationGuideline, ReferencePlane, Description, BaseCurve
brep_17 = Brep(deconstructgeometryinformation_17.Brep)
deconstructgeometryinformation_18 = DeconstructGeometryInformation(GeometryInformation=gh_circlesection_5.图元信息)  # -> Brep, AnnotationGuideline, ReferencePlane, Description, BaseCurve
brep_18 = Brep(deconstructgeometryinformation_18.Brep)
deconstructgeometryinformation_19 = DeconstructGeometryInformation(GeometryInformation=gh_circlesection_7.图元信息)  # -> Brep, AnnotationGuideline, ReferencePlane, Description, BaseCurve
brep_19 = Brep(deconstructgeometryinformation_19.Brep)
取正身椽面_无斗拱亭子 = 取正身椽面_无斗拱亭子(正身檐椽顶部线=gh_circlesection_5.顶部线, 正身椽顶部线=gh_circlesection_7.顶部线)  # -> 顶部正身椽面, 底部正身椽面
取翼角面_无斗拱亭子 = 取翼角面_无斗拱亭子(翼角檐椽线=取翼角檐椽线_无斗拱亭子.翼角檐椽线, 翼角檐椽尾曲线=取翼角檐椽线_无斗拱亭子.翼角檐椽尾曲线, 翼角檐椽顶线=取翼角檐椽线_无斗拱亭子.翼角檐椽顶线)
gh_face_5 = GH_Face(定位基面=取翼角面_无斗拱亭子, 名称="翼角望板", 上浮中心下沉="上浮", 偏移=Slider(0, range=0..2), 厚度=Slider(0.01, range=0..0.1))  # -> 图元信息, 顶部面, 中部面, 底部面
gh_face_6 = GH_Face(定位基面=取正身椽面_无斗拱亭子.顶部正身椽面, 名称="三角望板", 上浮中心下沉="上浮", 偏移=Slider(0, range=0..2), 厚度=Slider(0.01, range=0..0.1))  # -> 图元信息, 顶部面, 中部面, 底部面
gh_face_7 = GH_Face(定位基面=取正身椽面_无斗拱亭子.底部正身椽面, 名称="直望板", 上浮中心下沉="上浮", 偏移=Slider(0, range=0..2), 厚度=Slider(0.01, range=0..0.1))  # -> 图元信息, 顶部面, 中部面, 底部面
deconstructgeometryinformation_20 = DeconstructGeometryInformation(GeometryInformation=gh_face_5.图元信息)  # -> Brep, AnnotationGuideline, ReferencePlane, Description, BaseCurve
brep_20 = Brep(deconstructgeometryinformation_20.Brep)
deconstructgeometryinformation_21 = DeconstructGeometryInformation(GeometryInformation=gh_face_6.图元信息)  # -> Brep, AnnotationGuideline, ReferencePlane, Description, BaseCurve
brep_21 = Brep(deconstructgeometryinformation_21.Brep)
deconstructgeometryinformation_22 = DeconstructGeometryInformation(GeometryInformation=gh_face_7.图元信息)  # -> Brep, AnnotationGuideline, ReferencePlane, Description, BaseCurve
brep_22 = Brep(deconstructgeometryinformation_22.Brep)
number_slider_12 = Slider(0.39, range=0..1)
取飞椽线_偏移_无斗拱亭子 = 取飞椽线_偏移_无斗拱亭子(
    仔角梁图元信息=仔角梁图元信息,
    翼角檐椽顶部线=gh_circlesection_6.顶部线,
    翼角檐椽尾曲线=取翼角檐椽线_无斗拱亭子.翼角檐椽尾曲线,
    正身檐椽顶部线=gh_circlesection_5.顶部线,
    直飞椽顶端抬高=Slider(0.101, range=0..0.2),
    翼角飞椽尾端位置=number_slider_12,
    正身飞椽尾端位置=number_slider_12)  # -> 翼角飞椽线, 正身飞椽线, 飞椽尾部曲线, 飞椽尾部直线
number_slider_13 = Slider(0.029, range=0..0.1)
number_slider_14 = Slider(0, range=0..1)
number_slider_15 = Slider(0, range=0..1)
取衬头木面_无斗拱亭子 = 取衬头木面_无斗拱亭子(角梁图元信息=角梁图元信息, 正身檐椽线=gh_circlesection_5.顶部线, 檐檩顶部线=檐檩顶部线, 衬头木高=Slider(0.18, range=0..1), 衬头木厚=number_slider_13)
gh_face_8 = GH_Face(定位基面=取衬头木面_无斗拱亭子, 名称="衬头木", 上浮中心下沉="上浮", 偏移=Slider(0, range=0..1), 厚度=number_slider_13)  # -> 图元信息, 顶部面, 中部面, 底部面
gh_circlesection_8 = GH_CircleSection(
    定位基线=取飞椽线_偏移_无斗拱亭子.翼角飞椽线,
    名称="翼角飞椽",
    上浮中心下沉="下沉",
    偏移=Slider(0, range=0..100),
    开端出头=number_slider_15,
    尾端出头=number_slider_15,
    半径=椽半径,
    金盘占比=0,
    改动基准=True)  # -> 图元信息, 顶部线, 中部线, 底部线
gh_circlesection_9 = GH_CircleSection(
    定位基线=取飞椽线_偏移_无斗拱亭子.正身飞椽线,
    名称="正身飞椽",
    上浮中心下沉="下沉",
    偏移=Slider(0, range=0..100),
    开端出头=number_slider_14,
    尾端出头=number_slider_14,
    半径=椽半径,
    金盘占比=0,
    改动基准=True)  # -> 图元信息, 顶部线, 中部线, 底部线
deconstructgeometryinformation_23 = DeconstructGeometryInformation(GeometryInformation=gh_circlesection_8.图元信息)  # -> Brep, AnnotationGuideline, ReferencePlane, Description, BaseCurve
brep_23 = Brep(deconstructgeometryinformation_23.Brep)
deconstructgeometryinformation_24 = DeconstructGeometryInformation(GeometryInformation=gh_circlesection_9.图元信息)  # -> Brep, AnnotationGuideline, ReferencePlane, Description, BaseCurve
brep_24 = Brep(deconstructgeometryinformation_24.Brep)
deconstructgeometryinformation_25 = DeconstructGeometryInformation(GeometryInformation=gh_face_8.图元信息)  # -> Brep, AnnotationGuideline, ReferencePlane, Description, BaseCurve
brep_25 = Brep(deconstructgeometryinformation_25.Brep)
entwine_2 = Entwine(
    Branch0X=brep_10,
    Branch1X=brep_11,
    Branch2X=brep_7,
    Branch3X=brep_8,
    Branch4X=brep_9,
    Branch5X=brep_3,
    Branch6X=brep_4,
    Branch7X=brep_5,
    Branch8X=brep_6,
    Branch9X=brep,
    Branch10X=brep_2,
    Branch11X=brep_13,
    Branch12X=brep_14,
    Branch13X=brep_15,
    Branch14X=brep_16,
    Branch15X=brep_17,
    Branch16X=brep_18,
    Branch17X=brep_19,
    Branch18X=brep_23,
    Branch19X=brep_24,
    Branch20X=brep_25,
    Branch21X=brep_12,
    FlattenInputs=False)
tree_statistics = TreeStatistics(Tree=entwine_2)  # -> Paths, Length, Count
random = Random(Range=Domain(0, 1), Number=tree_statistics.Count, Seed=2)
gradient = Gradient(
    LowerLimit=0,
    UpperLimit=1,
    Parameter=random,
    stops=[0: RGB(234, 38, 0), 0.25: RGB(234, 126, 0), 0.5: RGB(254, 244, 84), 0.75: RGB(173, 203, 249), 1: RGB(75, 107, 169)])
graft_tree = GraftTree(Tree=gradient, IncludeEmptyLists=True, IncludeNullItems=True)
custom_preview = CustomPreview(Geometry=entwine_2, Material=graft_tree)
取飞椽望板面_无斗拱亭子 = 取飞椽望板面_无斗拱亭子(
    仔角梁图元信息=仔角梁图元信息,
    翼角飞椽顶部线=gh_circlesection_8.顶部线,
    正身飞椽顶部线=gh_circlesection_9.顶部线,
    飞椽尾部曲线=取飞椽线_偏移_无斗拱亭子.飞椽尾部曲线,
    飞椽尾部直线=取飞椽线_偏移_无斗拱亭子.飞椽尾部直线)  # -> 翼角飞椽面, 正身飞椽面
gh_face_9 = GH_Face(定位基面=取飞椽望板面_无斗拱亭子.翼角飞椽面, 名称="飞椽翼角望板", 上浮中心下沉="上浮", 偏移=Slider(0, range=0..2), 厚度=Slider(0.01, range=0..0.1))  # -> 图元信息, 顶部面, 中部面, 底部面
gh_face_10 = GH_Face(定位基面=取飞椽望板面_无斗拱亭子.正身飞椽面, 名称="飞椽正身望板", 上浮中心下沉="上浮", 偏移=Slider(0, range=0..2), 厚度=Slider(0.01, range=0..0.1))  # -> 图元信息, 顶部面, 中部面, 底部面
deconstructgeometryinformation_26 = DeconstructGeometryInformation(GeometryInformation=gh_face_9.图元信息)  # -> Brep, AnnotationGuideline, ReferencePlane, Description, BaseCurve
deconstructgeometryinformation_27 = DeconstructGeometryInformation(GeometryInformation=gh_face_10.图元信息)  # -> Brep, AnnotationGuideline, ReferencePlane, Description, BaseCurve

# ==== cluster 缩放
factor = ClusterInput()
geometry = ClusterInput()
factor_2 = Number(factor)
scale = Scale(Geometry=geometry, Center=Point(0, 0, 0), Factor=factor_2)  # -> Geometry, Transform
tree_statistics = TreeStatistics(Tree=scale.Geometry)  # -> Paths, Length, Count
list_item = ListItem(List=tree_statistics.Paths, Index=0, Wrap=True)  # -> Item, Item1, Item2, Item3
tree_branch = TreeBranch(Tree=scale.Geometry, Path=list_item.Item, MaintainPaths=True)
tree_branch_2 = TreeBranch(Tree=scale.Geometry, Path=list_item.Item1, MaintainPaths=True)
tree_branch_3 = TreeBranch(Tree=scale.Geometry, Path=list_item.Item2, MaintainPaths=True)
tree_branch_4 = TreeBranch(Tree=scale.Geometry, Path=list_item.Item3, MaintainPaths=True)
curve = Curve(tree_branch)
curve_2 = Curve(tree_branch_2)
curve_3 = Curve(tree_branch_3)
curve_4 = Curve(tree_branch_4)
curve_5 = ClusterOutput(curve)
curve_6 = ClusterOutput(curve_2)
curve_7 = ClusterOutput(curve_3)
curve_8 = ClusterOutput(curve_4)
