# Grasshopper definition 亭_偶数边形_重檐.gh (Grasshopper 1.0.8)
# plug-ins: Moonlight, MyGrasshopperAssembly1

# ----
# 柱高与面阔比
四五檩小式 = Panel("7:10")
六七檩小式 = Panel("8:10")
实际某六角亭 = Panel("1.1:1")

number_slider = Slider(5, range=1..11)
moonlight = Moonlight(Mode=Toggle(True))
circle = Circle(Plane=PlaneXY(0, 0, 0), Radius=Slider(1.7, range=0..10))
circle_2 = Circle(Plane=PlaneXY(0, 0, 0), Radius=Slider(1, range=0..10))

尺寸分析 = 尺寸分析(面阔="6.3", 柱高与面阔比="7:10", 柱径与柱高比="1:11", 步架与柱径比="4:1")  # -> 柱高, 柱径, 步架

取竖段线_无斗拱亭子 = 取竖段线_无斗拱亭子(面阔="6.3", 柱高=尺寸分析.柱高, 多边形边数=Slider(8, range=4..10))  # -> 柱顶点, 竖段线, 柱底点

柱径d = Number(尺寸分析.柱径)
金盘 = Number("0.05")

檩径权衡_无斗拱亭子 = 檩径权衡_无斗拱亭子(檐柱径D=柱径d, 金盘一侧与半径比=金盘)
垫板高宽权衡_无斗拱亭子 = 垫板高宽权衡_无斗拱亭子(檐柱径D=柱径d)
枋高宽权衡_无斗拱亭子 = 枋高宽权衡_无斗拱亭子(檐柱径D=柱径d)  # -> 檐枋尺寸, 金脊枋尺寸, 穿插枋尺寸
number_slider_2 = Slider(0.3, range=0..0.3)
number_slider_3 = Slider(0.44, range=0..1)
deconstructsquareprofile = DeconstructSquareProfile(SquareProfile=垫板高宽权衡_无斗拱亭子, trueButton=1)  # -> Expansion0, Expansion1, Height, Width
deconstructcircularprofile = DeconstructCircularProfile(CircularProfile=檩径权衡_无斗拱亭子)  # -> Radius, JinPan
deconstructsquareprofile_2 = DeconstructSquareProfile(SquareProfile=枋高宽权衡_无斗拱亭子.檐枋尺寸, trueButton=0)  # -> Height, Width
取横段线_无斗拱亭子 = 取横段线_无斗拱亭子(定位点=取竖段线_无斗拱亭子.柱顶点)
gh_rectanglesection = GH_RectangleSection(
    定位基线=取横段线_无斗拱亭子,
    名称="檐枋",
    上浮中心下沉="下沉",
    偏移=Slider(0, range=0..100),
    开端出头=number_slider_2,
    尾端出头=number_slider_2,
    高=deconstructsquareprofile_2.Height,
    宽=deconstructsquareprofile_2.Width,
    改动基准=False)  # -> 图元信息, 顶部线, 中部线, 底部线
gh_rectanglesection_2 = GH_RectangleSection(
    定位基线=gh_rectanglesection.顶部线,
    名称="檐垫板",
    上浮中心下沉="上浮",
    偏移=Slider(0, range=0..100),
    开端出头=deconstructsquareprofile.Expansion0,
    尾端出头=deconstructsquareprofile.Expansion1,
    高=deconstructsquareprofile.Height,
    宽=deconstructsquareprofile.Width,
    改动基准=False)  # -> 图元信息, 顶部线, 中部线, 底部线
gh_circlesection = GH_CircleSection(
    定位基线=gh_rectanglesection_2.顶部线,
    名称="檐檩",
    上浮中心下沉="上浮",
    偏移=Slider(0, range=0..100),
    开端出头=number_slider_3,
    尾端出头=number_slider_3,
    半径=deconstructcircularprofile.Radius,
    金盘占比=deconstructcircularprofile.JinPan,
    改动基准=False)  # -> 图元信息, 顶部线, 中部线, 底部线
deconstructgeometryinformation = DeconstructGeometryInformation(GeometryInformation=gh_rectanglesection_2.图元信息)  # -> Brep, AnnotationGuideline, ReferencePlane, Description, BaseCurve
deconstructgeometryinformation_2 = DeconstructGeometryInformation(GeometryInformation=gh_circlesection.图元信息)  # -> Brep, AnnotationGuideline, ReferencePlane, Description, BaseCurve
deconstructgeometryinformation_3 = DeconstructGeometryInformation(GeometryInformation=gh_rectanglesection.图元信息)  # -> Brep, AnnotationGuideline, ReferencePlane, Description, BaseCurve

檐檩图元信息 = Data(gh_circlesection.图元信息)
檐檩顶部线 = Data(gh_circlesection.顶部线)

curve = Curve([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])
curve_2 = Curve([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])
curve_3 = Curve([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])
curve_4 = Curve(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)

取步架_无斗拱亭子 = 取步架_无斗拱亭子(横段线=檐檩顶部线, 比例="1:0.6:0.8")  # -> 脊步架, 金步架, 檐步架, 上金檩横段线, 下金檩横段线

entwine = Entwine(Branch00=curve_2, Branch01=curve, Branch02=curve_3, Branch03=curve_4, FlattenInputs=True)
number_slider_4 = Slider(0, range=0..100)
缩放 = 缩放(geometry=entwine, factor=Slider(0.689, range=0..1), yfactor=Slider(1, range=0..1))  # -> curve_5, curve_6, curve_7, curve_8
柱径权衡_无斗拱亭子 = 柱径权衡_无斗拱亭子(檐柱径D=柱径d)  # -> 檐柱半径, 雷公柱半径
绘制挂落 = 绘制挂落(
    定位基线=gh_rectanglesection.底部线,
    柱径=柱径d,
    主体起始段=缩放.curve_5,
    主体中间段=缩放.curve_6,
    主体尾段=缩放.curve_7,
    边段=缩放.curve_8,
    主体宽=Slider(0.0118, range=0..0.02),
    边段宽=Slider(0.0248, range=0..0.03))  # -> 主体定位基面, 边段定位基面
gh_circlesection_2 = GH_CircleSection(
    定位基线=取竖段线_无斗拱亭子.竖段线,
    名称="檐柱",
    上浮中心下沉="中心",
    偏移=number_slider_4,
    开端出头=number_slider_4,
    尾端出头=number_slider_4,
    半径=柱径权衡_无斗拱亭子.檐柱半径,
    金盘占比=number_slider_4,
    改动基准=False)  # -> 图元信息, 顶部线, 中部线, 底部线
取横段线_无斗拱亭子_2 = 取横段线_无斗拱亭子(定位点=取竖段线_无斗拱亭子.柱底点)
取坐板_无斗拱亭子 = 取坐板_无斗拱亭子(
    定位基线=取横段线_无斗拱亭子_2,
    坐板宽=Slider(0.3, range=0..1),
    坐板外偏=Slider(0, range=0..1),
    端部坐板延申=Slider(0.1, range=0..1),
    移除第n项=Slider(1, range=0..10))
gh_face = GH_Face(定位基面=取坐板_无斗拱亭子, 名称="坐板", 上浮中心下沉="下沉", 偏移=Slider(0.66, range=0..2), 厚度=Slider(0.07, range=0..0.1))  # -> 图元信息, 顶部面, 中部面, 底部面
deconstructgeometryinformation_4 = DeconstructGeometryInformation(GeometryInformation=gh_circlesection_2.图元信息)  # -> Brep, AnnotationGuideline, ReferencePlane, Description, BaseCurve
deconstructgeometryinformation_5 = DeconstructGeometryInformation(GeometryInformation=gh_face.图元信息)  # -> Brep, AnnotationGuideline, ReferencePlane, Description, BaseCurve
gh_face_2 = GH_Face(定位基面=绘制挂落.主体定位基面, 名称="挂落主体", 上浮中心下沉="中心", 偏移=Slider(0, range=0..2), 厚度=Slider(0.02, range=0..0.1))  # -> 图元信息, 顶部面, 中部面, 底部面
gh_face_3 = GH_Face(定位基面=绘制挂落.边段定位基面, 名称="挂落边段", 上浮中心下沉="中心", 偏移=Slider(0, range=0..2), 厚度=Slider(0.04, range=0..0.1))  # -> 图元信息, 顶部面, 中部面, 底部面
取轴 = 取轴(定位基线=gh_circlesection_2.中部线)
取扒梁线_无斗拱亭子 = 取扒梁线_无斗拱亭子(檐檩横段线=檐檩顶部线, 金檩横段线=取步架_无斗拱亭子.下金檩横段线, Data=Slider(0, range=0..10), LastLeft=0)  # -> 扒梁长段线, 扒梁短段线
deconstructgeometryinformation_6 = DeconstructGeometryInformation(GeometryInformation=gh_face_2.图元信息)  # -> Brep, AnnotationGuideline, ReferencePlane, Description, BaseCurve
deconstructgeometryinformation_7 = DeconstructGeometryInformation(GeometryInformation=gh_face_3.图元信息)  # -> Brep, AnnotationGuideline, ReferencePlane, Description, BaseCurve
curve_5 = Curve(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)
deconstructbaseaxis = DeconstructBaseAxis(BaseAxis=取轴)  # -> AxisCurve, ReferencePlane, Positive
gh_revolution = GH_Revolution(定位轴=取轴, 名称="柱础", 偏移=Slider(0, range=0..100), 柱径D=柱径d, 旋转面=curve_5)
deconstructgeometryinformation_8 = DeconstructGeometryInformation(GeometryInformation=gh_revolution)  # -> Brep, AnnotationGuideline, ReferencePlane, Description, BaseCurve
梁高宽权衡_无斗拱亭子 = 梁高宽权衡_无斗拱亭子(檐柱径D=柱径d)  # -> 长短扒梁半高差, 长扒梁, 短扒梁, 多边形扒梁
梁高宽权衡_无斗拱亭子_2 = 梁高宽权衡_无斗拱亭子(檐柱径D=柱径d)  # -> 长短扒梁半高差, 长扒梁, 短扒梁, 多边形扒梁
number_slider_5 = Slider(0, range=0..0.5)
number_slider_6 = Slider(0, range=0..0.5)
number_slider_7 = Slider(0, range=0..0.5)
deconstructsquareprofile_3 = DeconstructSquareProfile(SquareProfile=梁高宽权衡_无斗拱亭子.长扒梁, trueButton=1)  # -> Expansion0, Expansion1, Height, Width
deconstructsquareprofile_4 = DeconstructSquareProfile(SquareProfile=梁高宽权衡_无斗拱亭子_2.短扒梁, trueButton=1)  # -> Expansion0, Expansion1, Height, Width
gh_rectanglesection_3 = GH_RectangleSection(
    定位基线=取扒梁线_无斗拱亭子.扒梁长段线,
    名称="长扒梁",
    上浮中心下沉="中心",
    偏移=Slider(0, range=0..1),
    开端出头=deconstructsquareprofile_3.Expansion0,
    尾端出头=deconstructsquareprofile_3.Expansion1,
    高=deconstructsquareprofile_3.Height,
    宽=deconstructsquareprofile_3.Width,
    改动基准=False)  # -> 图元信息, 顶部线, 中部线, 底部线
gh_rectanglesection_4 = GH_RectangleSection(
    定位基线=取扒梁线_无斗拱亭子.扒梁短段线,
    名称="短扒梁",
    上浮中心下沉="中心",
    偏移=梁高宽权衡_无斗拱亭子_2.长短扒梁半高差,
    开端出头=deconstructsquareprofile_4.Expansion0,
    尾端出头=deconstructsquareprofile_4.Expansion1,
    高=deconstructsquareprofile_4.Height,
    宽=deconstructsquareprofile_4.Width,
    改动基准=False)  # -> 图元信息, 顶部线, 中部线, 底部线
取横段线中心平面_无斗拱亭子 = 取横段线中心平面_无斗拱亭子(定位基线=gh_rectanglesection_3.顶部线)
横段线投影_无斗拱亭子 = 横段线投影_无斗拱亭子(定位基线=取步架_无斗拱亭子.下金檩横段线, 投影平面=取横段线中心平面_无斗拱亭子)
gh_rectanglesection_5 = GH_RectangleSection(
    定位基线=横段线投影_无斗拱亭子,
    名称="承椽枋",
    上浮中心下沉="上浮",
    偏移=Slider(0, range=0..100),
    开端出头=number_slider_7,
    尾端出头=number_slider_7,
    高=Slider(0.8, range=0..1),
    宽=Slider(0.2, range=0..1),
    改动基准=True)  # -> 图元信息, 顶部线, 中部线, 底部线
gh_rectanglesection_6 = GH_RectangleSection(
    定位基线=gh_rectanglesection_5.顶部线,
    名称="围脊板",
    上浮中心下沉="上浮",
    偏移=Slider(0, range=0..100),
    开端出头=number_slider_6,
    尾端出头=number_slider_6,
    高=Slider(0.4, range=0..1),
    宽=Slider(0.1, range=0..1),
    改动基准=True)  # -> 图元信息, 顶部线, 中部线, 底部线
gh_rectanglesection_7 = GH_RectangleSection(
    定位基线=gh_rectanglesection_6.顶部线,
    名称="维脊枋",
    上浮中心下沉="上浮",
    偏移=Slider(0, range=0..100),
    开端出头=number_slider_5,
    尾端出头=number_slider_5,
    高=Slider(0.2, range=0..1),
    宽=Slider(0.2, range=0..1),
    改动基准=True)  # -> 图元信息, 顶部线, 中部线, 底部线
deconstructgeometryinformation_9 = DeconstructGeometryInformation(GeometryInformation=gh_rectanglesection_7.图元信息)  # -> Brep, AnnotationGuideline, ReferencePlane, Description, BaseCurve
deconstructgeometryinformation_10 = DeconstructGeometryInformation(GeometryInformation=gh_rectanglesection_6.图元信息)  # -> Brep, AnnotationGuideline, ReferencePlane, Description, BaseCurve
deconstructgeometryinformation_11 = DeconstructGeometryInformation(GeometryInformation=gh_rectanglesection_5.图元信息)  # -> Brep, AnnotationGuideline, ReferencePlane, Description, BaseCurve
deconstructgeometryinformation_12 = DeconstructGeometryInformation(GeometryInformation=gh_rectanglesection_3.图元信息)  # -> Brep, AnnotationGuideline, ReferencePlane, Description, BaseCurve
deconstructgeometryinformation_13 = DeconstructGeometryInformation(GeometryInformation=gh_rectanglesection_4.图元信息)  # -> Brep, AnnotationGuideline, ReferencePlane, Description, BaseCurve
维脊枋顶部线 = Data(gh_rectanglesection_7.顶部线)
number_slider_8 = Slider(0, range=0..100)
柱径权衡_无斗拱亭子_2 = 柱径权衡_无斗拱亭子(檐柱径D=柱径d)  # -> 重檐金柱半径, 童柱半径
取横段内交线_无斗拱亭子 = 取横段内交线_无斗拱亭子(横段线=维脊枋顶部线)
横段线转竖段线_无斗拱亭子 = 横段线转竖段线_无斗拱亭子(横段线=取横段内交线_无斗拱亭子, 出头高=Slider(1, range=0..2), 是否贯通=Toggle(True))
gh_circlesection_3 = GH_CircleSection(
    定位基线=横段线转竖段线_无斗拱亭子,
    名称="重檐金柱",
    上浮中心下沉="中心",
    偏移=number_slider_8,
    开端出头=number_slider_8,
    尾端出头=number_slider_8,
    半径=柱径权衡_无斗拱亭子_2.重檐金柱半径,
    金盘占比=number_slider_8,
    改动基准=False)  # -> 图元信息, 顶部线, 中部线, 底部线
deconstructgeometryinformation_14 = DeconstructGeometryInformation(GeometryInformation=gh_circlesection_3.图元信息)  # -> Brep, AnnotationGuideline, ReferencePlane, Description, BaseCurve
檩径权衡_无斗拱亭子_2 = 檩径权衡_无斗拱亭子(檐柱径D=柱径d, 金盘一侧与半径比=金盘)
垫板高宽权衡_无斗拱亭子_2 = 垫板高宽权衡_无斗拱亭子(檐柱径D=柱径d)
角梁高宽权衡_无斗拱亭子 = 角梁高宽权衡_无斗拱亭子(檐柱径D=柱径d)
枋高宽权衡_无斗拱亭子_2 = 枋高宽权衡_无斗拱亭子(檐柱径D=柱径d)  # -> 檐枋尺寸, 金脊枋尺寸, 穿插枋尺寸
number_slider_9 = Slider(0.3, range=0..0.3)
number_slider_10 = Slider(0.44, range=0..1)
deconstructsquareprofile_5 = DeconstructSquareProfile(SquareProfile=垫板高宽权衡_无斗拱亭子_2, trueButton=1)  # -> Expansion0, Expansion1, Height, Width
deconstructsquareprofile_6 = DeconstructSquareProfile(SquareProfile=角梁高宽权衡_无斗拱亭子, trueButton=0)  # -> Height, Width
deconstructsquareprofile_7 = DeconstructSquareProfile(SquareProfile=角梁高宽权衡_无斗拱亭子, trueButton=0)  # -> Height, Width
deconstructcircularprofile_2 = DeconstructCircularProfile(CircularProfile=檩径权衡_无斗拱亭子_2)  # -> Radius, JinPan
deconstructsquareprofile_8 = DeconstructSquareProfile(SquareProfile=枋高宽权衡_无斗拱亭子_2.檐枋尺寸, trueButton=0)  # -> Height, Width
deconstructbasecurve = DeconstructBaseCurve(BaseCurve=gh_circlesection_3.中部线)  # -> Curve, ReferencePlane, Positive, ExtrudePlane
取角梁线_重檐_无斗拱亭子 = 取角梁线_重檐_无斗拱亭子(
    承椽枋线=gh_rectanglesection_5.中部线,
    檐檩顶部线=gh_circlesection.顶部线,
    承椽枋端下沉=Slider(0.38, range=0..1),
    檐檩顶端下沉=Slider(0.07, range=0..1))
gh_rectanglesection_8 = GH_RectangleSection(
    定位基线=取角梁线_重檐_无斗拱亭子,
    名称="角梁",
    上浮中心下沉="上浮",
    偏移=Slider(0, range=0..1),
    开端出头=Slider(0.28, range=0..1),
    尾端出头=Slider(0.78, range=0..1.5),
    高=deconstructsquareprofile_7.Height,
    宽=deconstructsquareprofile_7.Width,
    改动基准=True)  # -> 图元信息, 顶部线, 中部线, 底部线
取仔角梁面_无斗拱亭子 = 取仔角梁面_无斗拱亭子(角梁顶部线=gh_rectanglesection_8.顶部线, 仔角梁平段出头=Slider(0.923, range=0..1), 仔角梁截面高=Slider(0.33, range=0..0.5))
gh_face_4 = GH_Face(定位基面=取仔角梁面_无斗拱亭子, 名称="仔角梁", 上浮中心下沉="中心", 偏移=Slider(0, range=0..1), 厚度=deconstructsquareprofile_6.Width)  # -> 图元信息, 顶部面, 中部面, 底部面
end_points = EndPoints(Curve=deconstructbasecurve.Curve)  # -> Start, End
取横段线_无斗拱亭子_3 = 取横段线_无斗拱亭子(定位点=end_points.End)
gh_rectanglesection_9 = GH_RectangleSection(
    定位基线=取横段线_无斗拱亭子_3,
    名称="檐枋",
    上浮中心下沉="下沉",
    偏移=Slider(0, range=0..100),
    开端出头=number_slider_9,
    尾端出头=number_slider_9,
    高=deconstructsquareprofile_8.Height,
    宽=deconstructsquareprofile_8.Width,
    改动基准=False)  # -> 图元信息, 顶部线, 中部线, 底部线
gh_rectanglesection_10 = GH_RectangleSection(
    定位基线=gh_rectanglesection_9.顶部线,
    名称="檐垫板",
    上浮中心下沉="上浮",
    偏移=Slider(0, range=0..100),
    开端出头=deconstructsquareprofile_5.Expansion0,
    尾端出头=deconstructsquareprofile_5.Expansion1,
    高=deconstructsquareprofile_5.Height,
    宽=deconstructsquareprofile_5.Width,
    改动基准=False)  # -> 图元信息, 顶部线, 中部线, 底部线
gh_circlesection_4 = GH_CircleSection(
    定位基线=gh_rectanglesection_10.顶部线,
    名称="檐檩",
    上浮中心下沉="上浮",
    偏移=Slider(0, range=0..100),
    开端出头=number_slider_10,
    尾端出头=number_slider_10,
    半径=deconstructcircularprofile_2.Radius,
    金盘占比=deconstructcircularprofile_2.JinPan,
    改动基准=False)  # -> 图元信息, 顶部线, 中部线, 底部线
deconstructgeometryinformation_15 = DeconstructGeometryInformation(GeometryInformation=gh_face_4.图元信息)  # -> Brep, AnnotationGuideline, ReferencePlane, Description, BaseCurve
deconstructgeometryinformation_16 = DeconstructGeometryInformation(GeometryInformation=gh_rectanglesection_8.图元信息)  # -> Brep, AnnotationGuideline, ReferencePlane, Description, BaseCurve
deconstructgeometryinformation_17 = DeconstructGeometryInformation(GeometryInformation=gh_circlesection_4.图元信息)  # -> Brep, AnnotationGuideline, ReferencePlane, Description, BaseCurve
deconstructgeometryinformation_18 = DeconstructGeometryInformation(GeometryInformation=gh_rectanglesection_10.图元信息)  # -> Brep, AnnotationGuideline, ReferencePlane, Description, BaseCurve
deconstructgeometryinformation_19 = DeconstructGeometryInformation(GeometryInformation=gh_rectanglesection_9.图元信息)  # -> Brep, AnnotationGuideline, ReferencePlane, Description, BaseCurve
仔角梁图元信息 = Data(gh_face_4.图元信息)
角梁图元信息 = Data(gh_rectanglesection_8.图元信息)

檐檩图元信息_2 = Data(gh_circlesection_4.图元信息)
檐檩顶部线_2 = Data(gh_circlesection_4.顶部线)

椽半径 = Number(Slider(0.034, range=0..0.2))
number_slider_11 = Slider(0, range=0..1)
number_slider_12 = Slider(0, range=0..1)
curve_6 = Curve([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])
curve_7 = Curve([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])
curve_8 = Curve([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])
curve_9 = Curve(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)
entwine_2 = Entwine(Branch00=curve_8, Branch01=curve_6, Branch02=curve_7, Branch03=curve_9, FlattenInputs=True)
取正身檐椽线_重檐_无斗拱亭子 = 取正身檐椽线_重檐_无斗拱亭子(承椽枋线=gh_rectanglesection_5.中部线, 檐檩顶部线=檐檩顶部线, 檐檩图元信息=檐檩图元信息, 椽间距=Slider(0.09, range=0..1), 出檐=Slider(0.56, range=0..1.3))  # -> 真实椽间距, 正身檐椽线
gh_circlesection_5 = GH_CircleSection(
    定位基线=取正身檐椽线_重檐_无斗拱亭子.正身檐椽线,
    名称="正身檐椽",
    上浮中心下沉="上浮",
    偏移=Slider(0, range=0..100),
    开端出头=number_slider_12,
    尾端出头=number_slider_12,
    半径=椽半径,
    金盘占比=0,
    改动基准=True)  # -> 图元信息, 顶部线, 中部线, 底部线
取翼角檐椽线_无斗拱亭子 = 取翼角檐椽线_无斗拱亭子(
    正身檐椽线=gh_circlesection_5.顶部线,
    角梁图元信息=角梁图元信息,
    曲线控制点位置=Slider(0.52, range=0..0.7),
    翼角檐椽间距=Slider(0.11, range=0..0.3),
    翼角檐椽顶间隔=Slider(0.081, range=0..0.2))  # -> 翼角檐椽线, 翼角檐椽尾曲线, 翼角檐椽顶线, 翼角曲线控制点, 翼角檐椽实际间距
gh_circlesection_6 = GH_CircleSection(
    定位基线=取翼角檐椽线_无斗拱亭子.翼角檐椽线,
    名称="翼角檐椽",
    上浮中心下沉="下沉",
    偏移=Slider(0, range=0..100),
    开端出头=number_slider_11,
    尾端出头=number_slider_11,
    半径=椽半径,
    金盘占比=0,
    改动基准=True)  # -> 图元信息, 顶部线, 中部线, 底部线
缩放_2 = 缩放(geometry=entwine_2, factor=Slider(0.689, range=0..1), yfactor=Slider(1.48, range=0..3))  # -> curve_5, curve_6, curve_7, curve_8
multiplication = Multiplication(A=柱径权衡_无斗拱亭子_2.重檐金柱半径, B=2)
绘制挂落_2 = 绘制挂落(
    定位基线=gh_rectanglesection_9.底部线,
    柱径=multiplication,
    主体起始段=缩放_2.curve_5,
    主体中间段=缩放_2.curve_6,
    主体尾段=缩放_2.curve_7,
    边段=缩放_2.curve_8,
    主体宽=Slider(0.0118, range=0..0.02),
    边段宽=Slider(0.0248, range=0..0.03))  # -> 主体定位基面, 边段定位基面
deconstructgeometryinformation_20 = DeconstructGeometryInformation(GeometryInformation=gh_circlesection_6.图元信息)  # -> Brep, AnnotationGuideline, ReferencePlane, Description, BaseCurve
deconstructgeometryinformation_21 = DeconstructGeometryInformation(GeometryInformation=gh_circlesection_5.图元信息)  # -> Brep, AnnotationGuideline, ReferencePlane, Description, BaseCurve
取翼角面_无斗拱亭子 = 取翼角面_无斗拱亭子(翼角檐椽线=取翼角檐椽线_无斗拱亭子.翼角檐椽线, 翼角檐椽尾曲线=取翼角檐椽线_无斗拱亭子.翼角檐椽尾曲线, 翼角檐椽顶线=取翼角檐椽线_无斗拱亭子.翼角檐椽顶线)
gh_face_5 = GH_Face(定位基面=绘制挂落_2.主体定位基面, 名称="挂落主体", 上浮中心下沉="中心", 偏移=Slider(0, range=0..2), 厚度=Slider(0.02, range=0..0.1))  # -> 图元信息, 顶部面, 中部面, 底部面
gh_face_6 = GH_Face(定位基面=绘制挂落_2.边段定位基面, 名称="挂落边段", 上浮中心下沉="中心", 偏移=Slider(0, range=0..2), 厚度=Slider(0.04, range=0..0.1))  # -> 图元信息, 顶部面, 中部面, 底部面
deconstructgeometryinformation_22 = DeconstructGeometryInformation(GeometryInformation=gh_face_5.图元信息)  # -> Brep, AnnotationGuideline, ReferencePlane, Description, BaseCurve
deconstructgeometryinformation_23 = DeconstructGeometryInformation(GeometryInformation=gh_face_6.图元信息)  # -> Brep, AnnotationGuideline, ReferencePlane, Description, BaseCurve
取正身椽面_重檐_无斗拱亭子 = 取正身椽面_重檐_无斗拱亭子(正身檐椽顶部线=gh_circlesection_5.顶部线)
gh_face_7 = GH_Face(定位基面=取翼角面_无斗拱亭子, 名称="翼角望板", 上浮中心下沉="上浮", 偏移=Slider(0, range=0..2), 厚度=Slider(0.01, range=0..0.1))  # -> 图元信息, 顶部面, 中部面, 底部面
gh_face_8 = GH_Face(定位基面=取正身椽面_重檐_无斗拱亭子, 名称="直望板", 上浮中心下沉="上浮", 偏移=Slider(0, range=0..2), 厚度=Slider(0.01, range=0..0.1))  # -> 图元信息, 顶部面, 中部面, 底部面
deconstructgeometryinformation_24 = DeconstructGeometryInformation(GeometryInformation=gh_face_7.图元信息)  # -> Brep, AnnotationGuideline, ReferencePlane, Description, BaseCurve
deconstructgeometryinformation_25 = DeconstructGeometryInformation(GeometryInformation=gh_face_8.图元信息)  # -> Brep, AnnotationGuideline, ReferencePlane, Description, BaseCurve
取横段线中心平面_无斗拱亭子_2 = 取横段线中心平面_无斗拱亭子(定位基线=檐檩顶部线_2)
横段线投影_无斗拱亭子_2 = 横段线投影_无斗拱亭子(定位基线=取步架_无斗拱亭子.上金檩横段线, 投影平面=取横段线中心平面_无斗拱亭子_2)
取扒梁线_无斗拱亭子_2 = 取扒梁线_无斗拱亭子(檐檩横段线=檐檩顶部线_2, 金檩横段线=横段线投影_无斗拱亭子_2, Data=Slider(0, range=0..10), LastLeft=0)  # -> 扒梁长段线, 扒梁短段线
檩径权衡_无斗拱亭子_3 = 檩径权衡_无斗拱亭子(檐柱径D=柱径d, 金盘一侧与半径比=金盘)
梁高宽权衡_无斗拱亭子_3 = 梁高宽权衡_无斗拱亭子(檐柱径D=柱径d)  # -> 长短扒梁半高差, 长扒梁, 短扒梁, 多边形扒梁
梁高宽权衡_无斗拱亭子_4 = 梁高宽权衡_无斗拱亭子(檐柱径D=柱径d)  # -> 长短扒梁半高差, 长扒梁, 短扒梁, 多边形扒梁
枋高宽权衡_无斗拱亭子_3 = 枋高宽权衡_无斗拱亭子(檐柱径D=柱径d)  # -> 檐枋尺寸, 金脊枋尺寸, 穿插枋尺寸
number_slider_13 = Slider(0.31, range=0..0.5)
number_slider_14 = Slider(0, range=0..1)
number_slider_15 = Slider(0.39, range=0..1)
deconstructsquareprofile_9 = DeconstructSquareProfile(SquareProfile=梁高宽权衡_无斗拱亭子_3.长扒梁, trueButton=1)  # -> Expansion0, Expansion1, Height, Width
deconstructsquareprofile_10 = DeconstructSquareProfile(SquareProfile=梁高宽权衡_无斗拱亭子_4.短扒梁, trueButton=1)  # -> Expansion0, Expansion1, Height, Width
deconstructsquareprofile_11 = DeconstructSquareProfile(SquareProfile=枋高宽权衡_无斗拱亭子_3.金脊枋尺寸, trueButton=0)  # -> Height, Width
deconstructcircularprofile_3 = DeconstructCircularProfile(CircularProfile=檩径权衡_无斗拱亭子_3)  # -> Radius, JinPan
gh_rectanglesection_11 = GH_RectangleSection(
    定位基线=取扒梁线_无斗拱亭子_2.扒梁长段线,
    名称="长扒梁",
    上浮中心下沉="中心",
    偏移=Slider(0, range=0..1),
    开端出头=deconstructsquareprofile_9.Expansion0,
    尾端出头=deconstructsquareprofile_9.Expansion1,
    高=deconstructsquareprofile_9.Height,
    宽=deconstructsquareprofile_9.Width,
    改动基准=False)  # -> 图元信息, 顶部线, 中部线, 底部线
gh_rectanglesection_12 = GH_RectangleSection(
    定位基线=取扒梁线_无斗拱亭子_2.扒梁短段线,
    名称="短扒梁",
    上浮中心下沉="中心",
    偏移=梁高宽权衡_无斗拱亭子_4.长短扒梁半高差,
    开端出头=deconstructsquareprofile_10.Expansion0,
    尾端出头=deconstructsquareprofile_10.Expansion1,
    高=deconstructsquareprofile_10.Height,
    宽=deconstructsquareprofile_10.Width,
    改动基准=False)  # -> 图元信息, 顶部线, 中部线, 底部线
取横段线中心平面_无斗拱亭子_3 = 取横段线中心平面_无斗拱亭子(定位基线=gh_rectanglesection_11.顶部线)
横段线投影_无斗拱亭子_3 = 横段线投影_无斗拱亭子(定位基线=横段线投影_无斗拱亭子_2, 投影平面=取横段线中心平面_无斗拱亭子_3)
gh_rectanglesection_13 = GH_RectangleSection(
    定位基线=横段线投影_无斗拱亭子_3,
    名称="金枋",
    上浮中心下沉="上浮",
    偏移=Slider(0, range=0..100),
    开端出头=number_slider_13,
    尾端出头=number_slider_13,
    高=deconstructsquareprofile_11.Height,
    宽=deconstructsquareprofile_11.Width,
    改动基准=True)  # -> 图元信息, 顶部线, 中部线, 底部线
gh_circlesection_7 = GH_CircleSection(
    定位基线=gh_rectanglesection_13.顶部线,
    名称="金檩",
    上浮中心下沉="上浮",
    偏移=Slider(0, range=0..100),
    开端出头=number_slider_14,
    尾端出头=number_slider_14,
    半径=deconstructcircularprofile_3.Radius,
    金盘占比=deconstructcircularprofile_3.JinPan,
    改动基准=False)  # -> 图元信息, 顶部线, 中部线, 底部线
取飞椽线_偏移_无斗拱亭子 = 取飞椽线_偏移_无斗拱亭子(
    仔角梁图元信息=仔角梁图元信息,
    翼角檐椽顶部线=gh_circlesection_6.顶部线,
    翼角檐椽尾曲线=取翼角檐椽线_无斗拱亭子.翼角檐椽尾曲线,
    正身檐椽顶部线=gh_circlesection_5.顶部线,
    直飞椽顶端抬高=Slider(0.101, range=0..0.2),
    翼角飞椽尾端位置=number_slider_15,
    正身飞椽尾端位置=number_slider_15)  # -> 翼角飞椽线, 正身飞椽线, 飞椽尾部曲线, 飞椽尾部直线
deconstructgeometryinformation_26 = DeconstructGeometryInformation(GeometryInformation=gh_circlesection_7.图元信息)  # -> Brep, AnnotationGuideline, ReferencePlane, Description, BaseCurve
deconstructgeometryinformation_27 = DeconstructGeometryInformation(GeometryInformation=gh_rectanglesection_13.图元信息)  # -> Brep, AnnotationGuideline, ReferencePlane, Description, BaseCurve
deconstructgeometryinformation_28 = DeconstructGeometryInformation(GeometryInformation=gh_rectanglesection_11.图元信息)  # -> Brep, AnnotationGuideline, ReferencePlane, Description, BaseCurve
deconstructgeometryinformation_29 = DeconstructGeometryInformation(GeometryInformation=gh_rectanglesection_12.图元信息)  # -> Brep, AnnotationGuideline, ReferencePlane, Description, BaseCurve
number_slider_16 = Slider(0, range=0..1)
number_slider_17 = Slider(0, range=0..1)

金檩图元信息 = Data(gh_circlesection_7.图元信息)
金檩顶部线 = Data(gh_circlesection_7.顶部线)

金枋底部线 = Data(gh_rectanglesection_13.底部线)
gh_circlesection_8 = GH_CircleSection(
    定位基线=取飞椽线_偏移_无斗拱亭子.翼角飞椽线,
    名称="翼角飞椽",
    上浮中心下沉="下沉",
    偏移=Slider(0, range=0..100),
    开端出头=number_slider_17,
    尾端出头=number_slider_17,
    半径=椽半径,
    金盘占比=0,
    改动基准=True)  # -> 图元信息, 顶部线, 中部线, 底部线
gh_circlesection_9 = GH_CircleSection(
    定位基线=取飞椽线_偏移_无斗拱亭子.正身飞椽线,
    名称="正身飞椽",
    上浮中心下沉="下沉",
    偏移=Slider(0, range=0..100),
    开端出头=number_slider_16,
    尾端出头=number_slider_16,
    半径=椽半径,
    金盘占比=0,
    改动基准=True)  # -> 图元信息, 顶部线, 中部线, 底部线
deconstructgeometryinformation_30 = DeconstructGeometryInformation(GeometryInformation=gh_circlesection_8.图元信息)  # -> Brep, AnnotationGuideline, ReferencePlane, Description, BaseCurve
deconstructgeometryinformation_31 = DeconstructGeometryInformation(GeometryInformation=gh_circlesection_9.图元信息)  # -> Brep, AnnotationGuideline, ReferencePlane, Description, BaseCurve
取飞椽望板面_无斗拱亭子 = 取飞椽望板面_无斗拱亭子(
    仔角梁图元信息=仔角梁图元信息,
    翼角飞椽顶部线=gh_circlesection_8.顶部线,
    正身飞椽顶部线=gh_circlesection_9.顶部线,
    飞椽尾部曲线=取飞椽线_偏移_无斗拱亭子.飞椽尾部曲线,
    飞椽尾部直线=取飞椽线_偏移_无斗拱亭子.飞椽尾部直线)  # -> 翼角飞椽面, 正身飞椽面
角梁高宽权衡_无斗拱亭子_2 = 角梁高宽权衡_无斗拱亭子(檐柱径D=柱径d)
panel = Panel(取飞椽望板面_无斗拱亭子.正身飞椽面)
deconstructsquareprofile_12 = DeconstructSquareProfile(SquareProfile=角梁高宽权衡_无斗拱亭子_2, trueButton=0)  # -> Height, Width
deconstructsquareprofile_13 = DeconstructSquareProfile(SquareProfile=角梁高宽权衡_无斗拱亭子_2, trueButton=0)  # -> Height, Width
unit_z = UnitZ(Factor=Slider(0.06, range=0..0.3))

取举架_无斗拱亭子 = 取举架_无斗拱亭子(金檩顶定位基线=金檩顶部线, 檐檩顶定位基线=檐檩顶部线_2, 檐举架与脊举架比="1:2")  # -> 举架, 举架顶点

取横段内交线_无斗拱亭子_2 = 取横段内交线_无斗拱亭子(横段线=金檩顶部线)
deconstructbasecurve_2 = DeconstructBaseCurve(BaseCurve=取横段内交线_无斗拱亭子_2)  # -> Curve, ReferencePlane, Positive, ExtrudePlane
end_points_2 = EndPoints(Curve=deconstructbasecurve_2.Curve)  # -> Start, End
move = Move(Geometry=end_points_2.Start, Motion=unit_z)  # -> Geometry, Transform
取戗线_无斗拱亭子 = 取戗线_无斗拱亭子(戗续点=move.Geometry, 举架顶点=取举架_无斗拱亭子.举架顶点)
取角梁线_无斗拱亭子 = 取角梁线_无斗拱亭子(金枋底定位基线=金枋底部线, 檐檩顶定位基线=檐檩顶部线_2, 檐檩顶下沉=Slider(0.05, range=0..0.3))
gh_rectanglesection_14 = GH_RectangleSection(
    定位基线=取角梁线_无斗拱亭子,
    名称="角梁",
    上浮中心下沉="上浮",
    偏移=Slider(0, range=0..1),
    开端出头=Slider(0.28, range=0..1),
    尾端出头=Slider(0.62, range=0..0.75),
    高=deconstructsquareprofile_13.Height,
    宽=deconstructsquareprofile_13.Width,
    改动基准=True)  # -> 图元信息, 顶部线, 中部线, 底部线
取仔角梁面_无斗拱亭子_2 = 取仔角梁面_无斗拱亭子(角梁顶部线=gh_rectanglesection_14.顶部线, 仔角梁平段出头=Slider(0.569, range=0..1), 仔角梁截面高=Slider(0.3, range=0..0.5))
gh_face_9 = GH_Face(定位基面=取仔角梁面_无斗拱亭子_2, 名称="仔角梁", 上浮中心下沉="中心", 偏移=Slider(0, range=0..1), 厚度=deconstructsquareprofile_12.Width)  # -> 图元信息, 顶部面, 中部面, 底部面
gh_face_10 = GH_Face(定位基面=取飞椽望板面_无斗拱亭子.翼角飞椽面, 名称="飞椽翼角望板", 上浮中心下沉="上浮", 偏移=Slider(0, range=0..2), 厚度=Slider(0.01, range=0..0.1))  # -> 图元信息, 顶部面, 中部面, 底部面
gh_face_11 = GH_Face(定位基面=取飞椽望板面_无斗拱亭子.正身飞椽面, 名称="飞椽正身望板", 上浮中心下沉="上浮", 偏移=Slider(0, range=0..2), 厚度=Slider(0.01, range=0..0.1))  # -> 图元信息, 顶部面, 中部面, 底部面
number_slider_18 = Slider(0, range=0..100)
number_slider_19 = Slider(0, range=0..0.5)
deconstructgeometryinformation_32 = DeconstructGeometryInformation(GeometryInformation=gh_face_9.图元信息)  # -> Brep, AnnotationGuideline, ReferencePlane, Description, BaseCurve
deconstructgeometryinformation_33 = DeconstructGeometryInformation(GeometryInformation=gh_rectanglesection_14.图元信息)  # -> Brep, AnnotationGuideline, ReferencePlane, Description, BaseCurve
deconstructgeometryinformation_34 = DeconstructGeometryInformation(GeometryInformation=gh_face_10.图元信息)  # -> Brep, AnnotationGuideline, ReferencePlane, Description, BaseCurve
deconstructgeometryinformation_35 = DeconstructGeometryInformation(GeometryInformation=gh_face_11.图元信息)  # -> Brep, AnnotationGuideline, ReferencePlane, Description, BaseCurve
柱径权衡_无斗拱亭子_3 = 柱径权衡_无斗拱亭子(檐柱径D=柱径d)  # -> 檐柱半径, 雷公柱半径
仔角梁图元信息_2 = Data(gh_face_9.图元信息)
negative = Negative(Value=Slider(1.3, range=0..3))
角梁图元信息_2 = Data(gh_rectanglesection_14.图元信息)
取雷公柱线_小式亭子 = 取雷公柱线_小式亭子(举架顶点=取举架_无斗拱亭子.举架顶点, 举架顶点偏移=negative, 雷公柱高=Slider(2.1, range=0..3))
gh_circlesection_10 = GH_CircleSection(
    定位基线=取雷公柱线_小式亭子,
    名称="雷公柱",
    上浮中心下沉="中心",
    偏移=number_slider_18,
    开端出头=number_slider_18,
    尾端出头=number_slider_18,
    半径=柱径权衡_无斗拱亭子_3.雷公柱半径,
    金盘占比=number_slider_18,
    改动基准=False)  # -> 图元信息, 顶部线, 中部线, 底部线
gh_rectanglesection_15 = GH_RectangleSection(
    定位基线=取戗线_无斗拱亭子,
    名称="戗",
    上浮中心下沉="中心",
    偏移=Slider(0, range=0..100),
    开端出头=number_slider_19,
    尾端出头=number_slider_19,
    高=Slider(0.136, range=0..0.2),
    宽=Slider(0.146, range=0..0.2),
    改动基准=True)  # -> 图元信息, 顶部线, 中部线, 底部线
deconstructgeometryinformation_36 = DeconstructGeometryInformation(GeometryInformation=gh_rectanglesection_15.图元信息)  # -> Brep, AnnotationGuideline, ReferencePlane, Description, BaseCurve
deconstructgeometryinformation_37 = DeconstructGeometryInformation(GeometryInformation=gh_circlesection_10.图元信息)  # -> Brep, AnnotationGuideline, ReferencePlane, Description, BaseCurve

举架顶点 = Data(取举架_无斗拱亭子.举架顶点)
戗线 = Data(取戗线_无斗拱亭子)

取正身檐椽线_无斗拱亭子 = 取正身檐椽线_无斗拱亭子(金檩顶部线=金檩顶部线, 檐檩顶部线=檐檩顶部线_2, 金檩图元信息=金檩图元信息, 檐檩图元信息=檐檩图元信息_2, 椽间距=Slider(0.09, range=0..0.5), 出檐=Slider(0.36, range=0..1))  # -> 真实椽间距, 正身檐椽线
取正身椽线_无斗拱亭子 = 取正身椽线_无斗拱亭子(戗线=戗线, 举架顶点=举架顶点, 正身檐椽线=取正身檐椽线_无斗拱亭子.正身檐椽线)
椽半径_2 = Number(Slider(0.034, range=0..0.2))
number_slider_20 = Slider(0, range=0..1)
number_slider_21 = Slider(0, range=0..1)
number_slider_22 = Slider(0, range=0..1)
gh_circlesection_11 = GH_CircleSection(
    定位基线=取正身檐椽线_无斗拱亭子.正身檐椽线,
    名称="正身檐椽",
    上浮中心下沉="上浮",
    偏移=Slider(0, range=0..100),
    开端出头=number_slider_21,
    尾端出头=number_slider_21,
    半径=椽半径_2,
    金盘占比=0,
    改动基准=True)  # -> 图元信息, 顶部线, 中部线, 底部线
取翼角檐椽线_无斗拱亭子_2 = 取翼角檐椽线_无斗拱亭子(
    正身檐椽线=gh_circlesection_11.顶部线,
    角梁图元信息=角梁图元信息_2,
    曲线控制点位置=Slider(0.52, range=0..0.7),
    翼角檐椽间距=Slider(0.07, range=0..0.3),
    翼角檐椽顶间隔=Slider(0.102, range=0..0.2))  # -> 翼角檐椽线, 翼角檐椽尾曲线, 翼角檐椽顶线, 翼角曲线控制点, 翼角檐椽实际间距
gh_circlesection_12 = GH_CircleSection(
    定位基线=取翼角檐椽线_无斗拱亭子_2.翼角檐椽线,
    名称="翼角檐椽",
    上浮中心下沉="下沉",
    偏移=Slider(0, range=0..100),
    开端出头=number_slider_20,
    尾端出头=number_slider_20,
    半径=椽半径_2,
    金盘占比=0,
    改动基准=True)  # -> 图元信息, 顶部线, 中部线, 底部线
gh_circlesection_13 = GH_CircleSection(
    定位基线=取正身椽线_无斗拱亭子,
    名称="正身椽",
    上浮中心下沉="上浮",
    偏移=Slider(0, range=0..100),
    开端出头=number_slider_22,
    尾端出头=number_slider_22,
    半径=椽半径_2,
    金盘占比=0,
    改动基准=True)  # -> 图元信息, 顶部线, 中部线, 底部线
deconstructgeometryinformation_38 = DeconstructGeometryInformation(GeometryInformation=gh_circlesection_12.图元信息)  # -> Brep, AnnotationGuideline, ReferencePlane, Description, BaseCurve
deconstructgeometryinformation_39 = DeconstructGeometryInformation(GeometryInformation=gh_circlesection_11.图元信息)  # -> Brep, AnnotationGuideline, ReferencePlane, Description, BaseCurve
deconstructgeometryinformation_40 = DeconstructGeometryInformation(GeometryInformation=gh_circlesection_13.图元信息)  # -> Brep, AnnotationGuideline, ReferencePlane, Description, BaseCurve
取正身椽面_无斗拱亭子 = 取正身椽面_无斗拱亭子(正身檐椽顶部线=gh_circlesection_11.顶部线, 正身椽顶部线=gh_circlesection_13.顶部线)  # -> 顶部正身椽面, 底部正身椽面
取翼角面_无斗拱亭子_2 = 取翼角面_无斗拱亭子(翼角檐椽线=取翼角檐椽线_无斗拱亭子_2.翼角檐椽线, 翼角檐椽尾曲线=取翼角檐椽线_无斗拱亭子_2.翼角檐椽尾曲线, 翼角檐椽顶线=取翼角檐椽线_无斗拱亭子_2.翼角檐椽顶线)
gh_face_12 = GH_Face(定位基面=取翼角面_无斗拱亭子_2, 名称="翼角望板", 上浮中心下沉="上浮", 偏移=Slider(0, range=0..2), 厚度=Slider(0.01, range=0..0.1))  # -> 图元信息, 顶部面, 中部面, 底部面
gh_face_13 = GH_Face(定位基面=取正身椽面_无斗拱亭子.顶部正身椽面, 名称="三角望板", 上浮中心下沉="上浮", 偏移=Slider(0, range=0..2), 厚度=Slider(0.01, range=0..0.1))  # -> 图元信息, 顶部面, 中部面, 底部面
gh_face_14 = GH_Face(定位基面=取正身椽面_无斗拱亭子.底部正身椽面, 名称="直望板", 上浮中心下沉="上浮", 偏移=Slider(0, range=0..2), 厚度=Slider(0.01, range=0..0.1))  # -> 图元信息, 顶部面, 中部面, 底部面
deconstructgeometryinformation_41 = DeconstructGeometryInformation(GeometryInformation=gh_face_12.图元信息)  # -> Brep, AnnotationGuideline, ReferencePlane, Description, BaseCurve
deconstructgeometryinformation_42 = DeconstructGeometryInformation(GeometryInformation=gh_face_13.图元信息)  # -> Brep, AnnotationGuideline, ReferencePlane, Description, BaseCurve
deconstructgeometryinformation_43 = DeconstructGeometryInformation(GeometryInformation=gh_face_14.图元信息)  # -> Brep, AnnotationGuideline, ReferencePlane, Description, BaseCurve
number_slider_23 = Slider(0.39, range=0..1)
取飞椽线_偏移_无斗拱亭子_2 = 取飞椽线_偏移_无斗拱亭子(
    仔角梁图元信息=仔角梁图元信息_2,
    翼角檐椽顶部线=gh_circlesection_12.顶部线,
    翼角檐椽尾曲线=取翼角檐椽线_无斗拱亭子_2.翼角檐椽尾曲线,
    正身檐椽顶部线=gh_circlesection_11.顶部线,
    直飞椽顶端抬高=Slider(0.101, range=0..0.2),
    翼角飞椽尾端位置=number_slider_23,
    正身飞椽尾端位置=number_slider_23)  # -> 翼角飞椽线, 正身飞椽线, 飞椽尾部曲线, 飞椽尾部直线
number_slider_24 = Slider(0.029, range=0..0.1)
number_slider_25 = Slider(0, range=0..1)
number_slider_26 = Slider(0, range=0..1)
取衬头木面_无斗拱亭子 = 取衬头木面_无斗拱亭子(角梁图元信息=角梁图元信息_2, 正身檐椽线=gh_circlesection_11.顶部线, 檐檩顶部线=檐檩顶部线_2, 衬头木高=Slider(0.18, range=0..1), 衬头木厚=number_slider_24)
gh_face_15 = GH_Face(定位基面=取衬头木面_无斗拱亭子, 名称="衬头木", 上浮中心下沉="上浮", 偏移=Slider(0, range=0..1), 厚度=number_slider_24)  # -> 图元信息, 顶部面, 中部面, 底部面
gh_circlesection_14 = GH_CircleSection(
    定位基线=取飞椽线_偏移_无斗拱亭子_2.翼角飞椽线,
    名称="翼角飞椽",
    上浮中心下沉="下沉",
    偏移=Slider(0, range=0..100),
    开端出头=number_slider_26,
    尾端出头=number_slider_26,
    半径=椽半径_2,
    金盘占比=0,
    改动基准=True)  # -> 图元信息, 顶部线, 中部线, 底部线
gh_circlesection_15 = GH_CircleSection(
    定位基线=取飞椽线_偏移_无斗拱亭子_2.正身飞椽线,
    名称="正身飞椽",
    上浮中心下沉="下沉",
    偏移=Slider(0, range=0..100),
    开端出头=number_slider_25,
    尾端出头=number_slider_25,
    半径=椽半径_2,
    金盘占比=0,
    改动基准=True)  # -> 图元信息, 顶部线, 中部线, 底部线
deconstructgeometryinformation_44 = DeconstructGeometryInformation(GeometryInformation=gh_circlesection_14.图元信息)  # -> Brep, AnnotationGuideline, ReferencePlane, Description, BaseCurve
deconstructgeometryinformation_45 = DeconstructGeometryInformation(GeometryInformation=gh_circlesection_15.图元信息)  # -> Brep, AnnotationGuideline, ReferencePlane, Description, BaseCurve
deconstructgeometryinformation_46 = DeconstructGeometryInformation(GeometryInformation=gh_face_15.图元信息)  # -> Brep, AnnotationGuideline, ReferencePlane, Description, BaseCurve
取飞椽望板面_无斗拱亭子_2 = 取飞椽望板面_无斗拱亭子(
    仔角梁图元信息=仔角梁图元信息_2,
    翼角飞椽顶部线=gh_circlesection_14.顶部线,
    正身飞椽顶部线=gh_circlesection_15.顶部线,
    飞椽尾部曲线=取飞椽线_偏移_无斗拱亭子_2.飞椽尾部曲线,
    飞椽尾部直线=取飞椽线_偏移_无斗拱亭子_2.飞椽尾部直线)  # -> 翼角飞椽面, 正身飞椽面
panel_2 = Panel(取飞椽望板面_无斗拱亭子_2.正身飞椽面)
gh_face_16 = GH_Face(定位基面=取飞椽望板面_无斗拱亭子_2.翼角飞椽面, 名称="飞椽翼角望板", 上浮中心下沉="上浮", 偏移=Slider(0, range=0..2), 厚度=Slider(0.01, range=0..0.1))  # -> 图元信息, 顶部面, 中部面, 底部面
gh_face_17 = GH_Face(定位基面=取飞椽望板面_无斗拱亭子_2.正身飞椽面, 名称="飞椽正身望板", 上浮中心下沉="上浮", 偏移=Slider(0, range=0..2), 厚度=Slider(0.01, range=0..0.1))  # -> 图元信息, 顶部面, 中部面, 底部面
deconstructgeometryinformation_47 = DeconstructGeometryInformation(GeometryInformation=gh_face_16.图元信息)  # -> Brep, AnnotationGuideline, ReferencePlane, Description, BaseCurve
deconstructgeometryinformation_48 = DeconstructGeometryInformation(GeometryInformation=gh_face_17.图元信息)  # -> Brep, AnnotationGuideline, ReferencePlane, Description, BaseCurve

# ==== cluster 缩放
number_slider = Slider(1, range=0..1)
yfactor = ClusterInput()
factor = ClusterInput()
geometry = ClusterInput()
factor_2 = Number(factor)
scale = Scale(Geometry=geometry, Center=Point(0, 0, 0), Factor=factor_2)  # -> Geometry, Transform
yfactor_2 = Number(yfactor)
scale_nu = ScaleNU(Geometry=scale.Geometry, Plane=PlaneXY(0, 0, 0), ScaleX=number_slider, ScaleY=yfactor_2, ScaleZ=number_slider)  # -> Geometry, Transform
tree_statistics = TreeStatistics(Tree=scale_nu.Geometry)  # -> Paths, Length, Count
list_item = ListItem(List=tree_statistics.Paths, Index=0, Wrap=True)  # -> Item, Item1, Item2, Item3
tree_branch = TreeBranch(Tree=scale_nu.Geometry, Path=list_item.Item, MaintainPaths=True)
tree_branch_2 = TreeBranch(Tree=scale_nu.Geometry, Path=list_item.Item1, MaintainPaths=True)
tree_branch_3 = TreeBranch(Tree=scale_nu.Geometry, Path=list_item.Item2, MaintainPaths=True)
tree_branch_4 = TreeBranch(Tree=scale_nu.Geometry, Path=list_item.Item3, MaintainPaths=True)
curve = Curve(tree_branch)
curve_2 = Curve(tree_branch_2)
curve_3 = Curve(tree_branch_3)
curve_4 = Curve(tree_branch_4)
curve_5 = ClusterOutput(curve)
curve_6 = ClusterOutput(curve_2)
curve_7 = ClusterOutput(curve_3)
curve_8 = ClusterOutput(curve_4)
