# Grasshopper definition 硬山.gh (Grasshopper 1.0.8)
# plug-ins: Moonlight, MyGrasshopperAssembly1

四五檩小式 = Panel("7:10")
六七檩小式 = Panel("8:10")
panel = Panel("九檩")
panel_2 = Panel("五檩")
analysisdimensions = AnalysisDimensions(面阔="3.6;2.88;2.88", 柱高与面阔比=六七檩小式, 柱径与柱高比="1:11", 步架与柱径比="4:1")  # -> 通面阔, 柱高, 柱径, 步架
moonlight = Moonlight(Mode=Toggle(True))
步架到举架 = 步架到举架(规格="七檩", 柱高=analysisdimensions.柱高, 步架=analysisdimensions.步架)  # -> 举高, 通举高, 柱总高
柱顶点 = 柱顶点(步架=analysisdimensions.步架, 柱总高=步架到举架.柱总高)
面阔方向排布 = 面阔方向排布(面阔="3.6;2.88;2.88", 柱顶点=柱顶点)  # -> 移动, 面阔方向柱顶点, 外侧柱顶点, 内侧柱顶点, 檩向线
降垫板高 = 降垫板高(柱径D=analysisdimensions.柱径, 柱顶点=柱顶点)
面阔方向排布_2 = 面阔方向排布(面阔="3.6;2.88;2.88", 柱顶点=降垫板高)  # -> 移动, 面阔方向柱顶点, 外侧柱顶点, 内侧柱顶点, 檩向线
panel_3 = Panel("""步架还需要修正
小式廊步架一般为4-5D
卷棚顶步架一般为2-3D
带斗栱大式步架一般为檩径的4-5倍""")
柱径 = Number(analysisdimensions.柱径)
梁高宽权衡_普通屋架 = 梁高宽权衡_普通屋架(柱径D=柱径)  # -> 脊瓜柱尺寸, 三架梁下金瓜柱尺寸, 五架梁下金瓜柱尺寸
number_slider = Slider(0, range=0..100)
deconstructsquareprofile = DeconstructSquareProfile(SquareProfile=梁高宽权衡_普通屋架.脊瓜柱尺寸, trueButton=1)  # -> Expansion0, Expansion1, Height, Width
取竖段线 = 取竖段线(柱顶点=面阔方向排布_2.内侧柱顶点, 檩索引=Slider(0, range=0..6), 是否对称=True)
取竖段线_2 = 取竖段线(柱顶点=面阔方向排布_2.内侧柱顶点, 檩索引=Slider(1, range=0..6), 是否对称=True)
deconstructbasecurve = DeconstructBaseCurve(BaseCurve=取竖段线_2)  # -> Curve, ReferencePlane, Positive, ExtrudePlane
gh_rectanglesection = GH_RectangleSection(
    定位基线=取竖段线,
    名称="瓜柱-边柱",
    上浮中心下沉="中心",
    偏移=Slider(0, range=0..100),
    开端出头=deconstructsquareprofile.Expansion0,
    尾端出头=deconstructsquareprofile.Expansion1,
    高=deconstructsquareprofile.Height,
    宽=deconstructsquareprofile.Width,
    改动基准=False)  # -> 图元信息, 顶部线, 中部线, 底部线
deconstructbasecurve_2 = DeconstructBaseCurve(BaseCurve=取竖段线)  # -> Curve, ReferencePlane, Positive, ExtrudePlane
deconstructgeometryinformation = DeconstructGeometryInformation(GeometryInformation=gh_rectanglesection.图元信息)  # -> Brep, AnnotationGuideline, ReferencePlane, Description, BaseCurve
柱径权衡 = 柱径权衡(柱径D=柱径)  # -> 檐柱半径, 金柱半径, 中柱半径, 山柱半径, 重檐金柱半径
梁高宽权衡_普通屋架_2 = 梁高宽权衡_普通屋架(柱径D=柱径)  # -> 三架梁尺寸, 五架梁尺寸, 抱头梁尺寸, 随梁尺寸
梁高宽权衡_普通屋架_3 = 梁高宽权衡_普通屋架(柱径D=柱径)  # -> 三架梁尺寸, 五架梁尺寸, 抱头梁尺寸, 随梁尺寸
number_slider_2 = Slider(0, range=0..100)
number_slider_3 = Slider(0, range=0..1)
deconstructsquareprofile_2 = DeconstructSquareProfile(SquareProfile=梁高宽权衡_普通屋架_3.三架梁尺寸, trueButton=1)  # -> Expansion0, Expansion1, Height, Width
deconstructsquareprofile_3 = DeconstructSquareProfile(SquareProfile=梁高宽权衡_普通屋架_3.五架梁尺寸, trueButton=1)  # -> Expansion0, Expansion1, Height, Width
deconstructsquareprofile_4 = DeconstructSquareProfile(SquareProfile=梁高宽权衡_普通屋架_2.三架梁尺寸, trueButton=1)  # -> Expansion0, Expansion1, Height, Width
deconstructsquareprofile_5 = DeconstructSquareProfile(SquareProfile=梁高宽权衡_普通屋架_2.五架梁尺寸, trueButton=1)  # -> Expansion0, Expansion1, Height, Width
deconstructsquareprofile_6 = DeconstructSquareProfile(SquareProfile=梁高宽权衡_普通屋架_2.抱头梁尺寸, trueButton=1)  # -> Expansion0, Expansion1, Height, Width
deconstructsquareprofile_7 = DeconstructSquareProfile(SquareProfile=梁高宽权衡_普通屋架_3.抱头梁尺寸, trueButton=1)  # -> Expansion0, Expansion1, Height, Width
deconstructcircularprofile = DeconstructCircularProfile(CircularProfile=柱径权衡.金柱半径)  # -> Radius, JinPan
deconstructcircularprofile_2 = DeconstructCircularProfile(CircularProfile=柱径权衡.金柱半径)  # -> Radius, JinPan
deconstructcircularprofile_3 = DeconstructCircularProfile(CircularProfile=柱径权衡.檐柱半径)  # -> Radius, JinPan
deconstructcircularprofile_4 = DeconstructCircularProfile(CircularProfile=柱径权衡.檐柱半径)  # -> Radius, JinPan
水平贯通 = 水平贯通(柱顶点=面阔方向排布_2.外侧柱顶点, 檩索引=Slider(1, range=0..10))
gh_rectanglesection_2 = GH_RectangleSection(
    定位基线=水平贯通,
    名称="三架梁",
    上浮中心下沉="上浮",
    偏移=Slider(0, range=0..100),
    开端出头=deconstructsquareprofile_4.Expansion0,
    尾端出头=deconstructsquareprofile_4.Expansion1,
    高=deconstructsquareprofile_4.Height,
    宽=deconstructsquareprofile_4.Width,
    改动基准=False)  # -> 图元信息, 顶部线, 中部线, 底部线
水平贯通_2 = 水平贯通(柱顶点=面阔方向排布_2.外侧柱顶点, 檩索引=Slider(2, range=0..10))
gh_rectanglesection_3 = GH_RectangleSection(
    定位基线=水平贯通_2,
    名称="五架梁",
    上浮中心下沉="上浮",
    偏移=Slider(0, range=0..100),
    开端出头=deconstructsquareprofile_5.Expansion0,
    尾端出头=deconstructsquareprofile_5.Expansion1,
    高=deconstructsquareprofile_5.Height,
    宽=deconstructsquareprofile_5.Width,
    改动基准=False)  # -> 图元信息, 顶部线, 中部线, 底部线
水平贯通_3 = 水平贯通(柱顶点=面阔方向排布_2.内侧柱顶点, 檩索引=Slider(1, range=0..10))
gh_rectanglesection_4 = GH_RectangleSection(
    定位基线=水平贯通_3,
    名称="三架梁",
    上浮中心下沉="上浮",
    偏移=Slider(0, range=0..100),
    开端出头=deconstructsquareprofile_2.Expansion0,
    尾端出头=deconstructsquareprofile_2.Expansion1,
    高=deconstructsquareprofile_2.Height,
    宽=deconstructsquareprofile_2.Width,
    改动基准=False)  # -> 图元信息, 顶部线, 中部线, 底部线
水平贯通_4 = 水平贯通(柱顶点=面阔方向排布_2.内侧柱顶点, 檩索引=Slider(2, range=0..10))
gh_rectanglesection_5 = GH_RectangleSection(
    定位基线=水平贯通_4,
    名称="五架梁",
    上浮中心下沉="上浮",
    偏移=Slider(0, range=0..100),
    开端出头=deconstructsquareprofile_3.Expansion0,
    尾端出头=deconstructsquareprofile_3.Expansion1,
    高=deconstructsquareprofile_3.Height,
    宽=deconstructsquareprofile_3.Width,
    改动基准=False)  # -> 图元信息, 顶部线, 中部线, 底部线
取横段线 = 取横段线(柱顶点=面阔方向排布_2.外侧柱顶点, 段索引=Slider(3, range=0..6), 是否对称=True)
gh_rectanglesection_6 = GH_RectangleSection(
    定位基线=取横段线,
    名称="抱头梁",
    上浮中心下沉="上浮",
    偏移=Slider(0, range=0..100),
    开端出头=deconstructsquareprofile_6.Expansion0,
    尾端出头=deconstructsquareprofile_6.Expansion1,
    高=deconstructsquareprofile_6.Height,
    宽=deconstructsquareprofile_6.Width,
    改动基准=False)  # -> 图元信息, 顶部线, 中部线, 底部线
取横段线_2 = 取横段线(柱顶点=面阔方向排布_2.内侧柱顶点, 段索引=Slider(3, range=0..6), 是否对称=True)
gh_rectanglesection_7 = GH_RectangleSection(
    定位基线=取横段线_2,
    名称="抱头梁",
    上浮中心下沉="上浮",
    偏移=Slider(0, range=0..100),
    开端出头=deconstructsquareprofile_7.Expansion0,
    尾端出头=deconstructsquareprofile_7.Expansion1,
    高=deconstructsquareprofile_7.Height,
    宽=deconstructsquareprofile_7.Width,
    改动基准=False)  # -> 图元信息, 顶部线, 中部线, 底部线
竖直贯通 = 竖直贯通(柱顶点=面阔方向排布.外侧柱顶点, 檩索引=Slider(2, range=0..6))
gh_circlesection = GH_CircleSection(
    定位基线=竖直贯通,
    名称="檐柱-角柱",
    上浮中心下沉="中心",
    偏移=Slider(0, range=0..100),
    开端出头=Slider(0, range=0..1),
    尾端出头=Slider(0, range=0..1),
    半径=deconstructcircularprofile_3.Radius,
    金盘占比=deconstructcircularprofile_3.JinPan,
    改动基准=False)  # -> 图元信息, 顶部线, 中部线, 底部线
竖直贯通_2 = 竖直贯通(柱顶点=面阔方向排布.外侧柱顶点, 檩索引=Slider(3, range=0..6))
gh_circlesection_2 = GH_CircleSection(
    定位基线=竖直贯通_2,
    名称="金柱-边柱",
    上浮中心下沉="中心",
    偏移=Slider(0, range=0..100),
    开端出头=Slider(0, range=0..1),
    尾端出头=Slider(0, range=0..1),
    半径=deconstructcircularprofile.Radius,
    金盘占比=deconstructcircularprofile.JinPan,
    改动基准=False)  # -> 图元信息, 顶部线, 中部线, 底部线
竖直贯通_3 = 竖直贯通(柱顶点=面阔方向排布.内侧柱顶点, 檩索引=Slider(2, range=0..6))
gh_circlesection_3 = GH_CircleSection(
    定位基线=竖直贯通_3,
    名称="檐柱-角柱",
    上浮中心下沉="中心",
    偏移=Slider(0, range=0..100),
    开端出头=Slider(0, range=0..1),
    尾端出头=Slider(0, range=0..1),
    半径=deconstructcircularprofile_4.Radius,
    金盘占比=deconstructcircularprofile_4.JinPan,
    改动基准=False)  # -> 图元信息, 顶部线, 中部线, 底部线
竖直贯通_4 = 竖直贯通(柱顶点=面阔方向排布.内侧柱顶点, 檩索引=Slider(3, range=0..6))
gh_circlesection_4 = GH_CircleSection(
    定位基线=竖直贯通_4,
    名称="金柱-边柱",
    上浮中心下沉="中心",
    偏移=number_slider_2,
    开端出头=number_slider_2,
    尾端出头=Slider(0, range=0..1),
    半径=deconstructcircularprofile_2.Radius,
    金盘占比=deconstructcircularprofile_2.JinPan,
    改动基准=False)  # -> 图元信息, 顶部线, 中部线, 底部线
deconstructgeometryinformation_2 = DeconstructGeometryInformation(GeometryInformation=gh_rectanglesection_2.图元信息)  # -> Brep, AnnotationGuideline, ReferencePlane, Description, BaseCurve
deconstructgeometryinformation_3 = DeconstructGeometryInformation(GeometryInformation=gh_rectanglesection_3.图元信息)  # -> Brep, AnnotationGuideline, ReferencePlane, Description, BaseCurve
deconstructgeometryinformation_4 = DeconstructGeometryInformation(GeometryInformation=gh_rectanglesection_6.图元信息)  # -> Brep, AnnotationGuideline, ReferencePlane, Description, BaseCurve
deconstructgeometryinformation_5 = DeconstructGeometryInformation(GeometryInformation=gh_rectanglesection_4.图元信息)  # -> Brep, AnnotationGuideline, ReferencePlane, Description, BaseCurve
deconstructgeometryinformation_6 = DeconstructGeometryInformation(GeometryInformation=gh_rectanglesection_5.图元信息)  # -> Brep, AnnotationGuideline, ReferencePlane, Description, BaseCurve
deconstructgeometryinformation_7 = DeconstructGeometryInformation(GeometryInformation=gh_rectanglesection_7.图元信息)  # -> Brep, AnnotationGuideline, ReferencePlane, Description, BaseCurve
deconstructgeometryinformation_8 = DeconstructGeometryInformation(GeometryInformation=gh_circlesection.图元信息)  # -> Brep, AnnotationGuideline, ReferencePlane, Description, BaseCurve
deconstructgeometryinformation_9 = DeconstructGeometryInformation(GeometryInformation=gh_circlesection_2.图元信息)  # -> Brep, AnnotationGuideline, ReferencePlane, Description, BaseCurve
deconstructgeometryinformation_10 = DeconstructGeometryInformation(GeometryInformation=gh_circlesection_3.图元信息)  # -> Brep, AnnotationGuideline, ReferencePlane, Description, BaseCurve
deconstructgeometryinformation_11 = DeconstructGeometryInformation(GeometryInformation=gh_circlesection_4.图元信息)  # -> Brep, AnnotationGuideline, ReferencePlane, Description, BaseCurve
panel_4 = Panel(deconstructgeometryinformation_11.AnnotationGuideline)
deconstructsquareprofile_8 = DeconstructSquareProfile(SquareProfile=梁高宽权衡_普通屋架_3.随梁尺寸, trueButton=1)  # -> Expansion0, Expansion1, Height, Width
deconstructsquareprofile_9 = DeconstructSquareProfile(SquareProfile=梁高宽权衡_普通屋架_2.随梁尺寸, trueButton=1)  # -> Expansion0, Expansion1, Height, Width
gh_rectanglesection_8 = GH_RectangleSection(
    定位基线=gh_rectanglesection_3.底部线,
    名称="随梁",
    上浮中心下沉="下沉",
    偏移=Slider(0, range=0..100),
    开端出头=deconstructsquareprofile_9.Expansion0,
    尾端出头=deconstructsquareprofile_9.Expansion1,
    高=deconstructsquareprofile_9.Height,
    宽=deconstructsquareprofile_9.Width,
    改动基准=False)  # -> 图元信息, 顶部线, 中部线, 底部线
gh_rectanglesection_9 = GH_RectangleSection(
    定位基线=gh_rectanglesection_5.底部线,
    名称="随梁",
    上浮中心下沉="下沉",
    偏移=Slider(0, range=0..100),
    开端出头=deconstructsquareprofile_8.Expansion0,
    尾端出头=deconstructsquareprofile_8.Expansion1,
    高=deconstructsquareprofile_8.Height,
    宽=deconstructsquareprofile_8.Width,
    改动基准=False)  # -> 图元信息, 顶部线, 中部线, 底部线
deconstructcircularprofile_5 = DeconstructCircularProfile(CircularProfile=柱径权衡.山柱半径)  # -> Radius, JinPan
deconstructgeometryinformation_12 = DeconstructGeometryInformation(GeometryInformation=gh_rectanglesection_8.图元信息)  # -> Brep, AnnotationGuideline, ReferencePlane, Description, BaseCurve
deconstructgeometryinformation_13 = DeconstructGeometryInformation(GeometryInformation=gh_rectanglesection_9.图元信息)  # -> Brep, AnnotationGuideline, ReferencePlane, Description, BaseCurve
竖直贯通_5 = 竖直贯通(柱顶点=面阔方向排布.外侧柱顶点, 檩索引=Slider(0, range=0..6))
gh_circlesection_5 = GH_CircleSection(
    定位基线=竖直贯通_5,
    名称="金柱-边柱",
    上浮中心下沉="中心",
    偏移=Slider(0, range=0..100),
    开端出头=Slider(0, range=0..1),
    尾端出头=Slider(0, range=0..1),
    半径=deconstructcircularprofile_5.Radius,
    金盘占比=deconstructcircularprofile_5.JinPan,
    改动基准=False)  # -> 图元信息, 顶部线, 中部线, 底部线
deconstructgeometryinformation_14 = DeconstructGeometryInformation(GeometryInformation=gh_circlesection_5.图元信息)  # -> Brep, AnnotationGuideline, ReferencePlane, Description, BaseCurve
deconstructsquareprofile_10 = DeconstructSquareProfile(SquareProfile=梁高宽权衡_普通屋架_2.随梁尺寸, trueButton=1)  # -> Expansion0, Expansion1, Height, Width
deconstructsquareprofile_11 = DeconstructSquareProfile(SquareProfile=梁高宽权衡_普通屋架_3.随梁尺寸, trueButton=1)  # -> Expansion0, Expansion1, Height, Width
negative = Negative(Value=Slider(1.09, range=0..100))
檩径权衡 = 檩径权衡(柱径D=柱径, 金盘一侧与半径比="0.05")  # -> 檐金脊檩尺寸, 扶脊木尺寸
boolean_toggle = BooleanToggle(True)
檩向线分类 = 檩向线分类(檩向线分类=面阔方向排布.檩向线, IsCombine=True)  # -> 脊檩, 金檩0, 金檩1, 檐檩
梁高宽权衡_普通屋架_4 = 梁高宽权衡_普通屋架(柱径D=柱径)  # -> 三架梁尺寸, 五架梁尺寸, 抱头梁尺寸, 随梁尺寸
gh_rectanglesection_10 = GH_RectangleSection(
    定位基线=gh_rectanglesection_7.底部线,
    名称="穿插枋",
    上浮中心下沉="下沉",
    偏移=negative,
    开端出头=deconstructsquareprofile_11.Expansion0,
    尾端出头=deconstructsquareprofile_11.Expansion1,
    高=deconstructsquareprofile_11.Height,
    宽=deconstructsquareprofile_11.Width,
    改动基准=False)  # -> 图元信息, 顶部线, 中部线, 底部线
gh_rectanglesection_11 = GH_RectangleSection(
    定位基线=gh_rectanglesection_6.底部线,
    名称="穿插枋",
    上浮中心下沉="下沉",
    偏移=negative,
    开端出头=deconstructsquareprofile_10.Expansion0,
    尾端出头=deconstructsquareprofile_10.Expansion1,
    高=deconstructsquareprofile_10.Height,
    宽=deconstructsquareprofile_10.Width,
    改动基准=False)  # -> 图元信息, 顶部线, 中部线, 底部线
deconstructgeometryinformation_15 = DeconstructGeometryInformation(GeometryInformation=gh_rectanglesection_11.图元信息)  # -> Brep, AnnotationGuideline, ReferencePlane, Description, BaseCurve
deconstructgeometryinformation_16 = DeconstructGeometryInformation(GeometryInformation=gh_rectanglesection_10.图元信息)  # -> Brep, AnnotationGuideline, ReferencePlane, Description, BaseCurve
deconstructcircularprofile_6 = DeconstructCircularProfile(CircularProfile=檩径权衡.檐金脊檩尺寸)  # -> Radius, JinPan
deconstructcircularprofile_7 = DeconstructCircularProfile(CircularProfile=檩径权衡.檐金脊檩尺寸)  # -> Radius, JinPan
deconstructcircularprofile_8 = DeconstructCircularProfile(CircularProfile=檩径权衡.檐金脊檩尺寸)  # -> Radius, JinPan
deconstructcircularprofile_9 = DeconstructCircularProfile(CircularProfile=檩径权衡.檐金脊檩尺寸)  # -> Radius, JinPan
readoutputitemandnickname = ReadOutputItemAndNickName(ItemInfo=檩向线分类.金檩0, inputNickName="金檩0")  # -> Item, NickName
readoutputitemandnickname_2 = ReadOutputItemAndNickName(ItemInfo=檩向线分类.檐檩, inputNickName="檐檩")  # -> Item, NickName
readoutputitemandnickname_3 = ReadOutputItemAndNickName(ItemInfo=檩向线分类.金檩1, inputNickName="金檩1")  # -> Item, NickName
readoutputitemandnickname_4 = ReadOutputItemAndNickName(ItemInfo=檩向线分类.脊檩, inputNickName="脊檩")  # -> Item, NickName
取半宽 = 取半宽(尺寸=梁高宽权衡_普通屋架_4.五架梁尺寸)  # -> 正半宽, 负半宽
取半宽_2 = 取半宽(尺寸=梁高宽权衡_普通屋架_4.三架梁尺寸)  # -> 正半宽, 负半宽
取半宽_3 = 取半宽(尺寸=梁高宽权衡_普通屋架_4.三架梁尺寸)  # -> 正半宽, 负半宽
取半宽_4 = 取半宽(尺寸=梁高宽权衡_普通屋架_4.抱头梁尺寸)  # -> 正半宽, 负半宽
gh_circlesection_6 = GH_CircleSection(
    定位基线=readoutputitemandnickname_3.Item,
    名称=readoutputitemandnickname_3.NickName,
    上浮中心下沉="上浮",
    偏移=Slider(0, range=0..100),
    开端出头=取半宽.正半宽,
    尾端出头=取半宽.正半宽,
    半径=deconstructcircularprofile_8.Radius,
    金盘占比=deconstructcircularprofile_8.JinPan,
    改动基准=boolean_toggle)  # -> 图元信息, 顶部线, 中部线, 底部线
gh_circlesection_7 = GH_CircleSection(
    定位基线=readoutputitemandnickname_2.Item,
    名称=readoutputitemandnickname_2.NickName,
    上浮中心下沉="上浮",
    偏移=Slider(0, range=0..100),
    开端出头=取半宽_4.正半宽,
    尾端出头=取半宽_4.正半宽,
    半径=deconstructcircularprofile_9.Radius,
    金盘占比=deconstructcircularprofile_9.JinPan,
    改动基准=boolean_toggle)  # -> 图元信息, 顶部线, 中部线, 底部线
gh_circlesection_8 = GH_CircleSection(
    定位基线=readoutputitemandnickname_4.Item,
    名称=readoutputitemandnickname_4.NickName,
    上浮中心下沉="上浮",
    偏移=Slider(0, range=0..100),
    开端出头=取半宽_2.正半宽,
    尾端出头=取半宽_2.正半宽,
    半径=deconstructcircularprofile_6.Radius,
    金盘占比=deconstructcircularprofile_6.JinPan,
    改动基准=boolean_toggle)  # -> 图元信息, 顶部线, 中部线, 底部线
gh_circlesection_9 = GH_CircleSection(
    定位基线=readoutputitemandnickname.Item,
    名称=readoutputitemandnickname.NickName,
    上浮中心下沉="上浮",
    偏移=Slider(0, range=0..100),
    开端出头=取半宽_3.正半宽,
    尾端出头=取半宽_3.正半宽,
    半径=deconstructcircularprofile_7.Radius,
    金盘占比=deconstructcircularprofile_7.JinPan,
    改动基准=boolean_toggle)  # -> 图元信息, 顶部线, 中部线, 底部线
deconstructgeometryinformation_17 = DeconstructGeometryInformation(GeometryInformation=gh_circlesection_8.图元信息)  # -> Brep, AnnotationGuideline, ReferencePlane, Description, BaseCurve
deconstructgeometryinformation_18 = DeconstructGeometryInformation(GeometryInformation=gh_circlesection_9.图元信息)  # -> Brep, AnnotationGuideline, ReferencePlane, Description, BaseCurve
deconstructgeometryinformation_19 = DeconstructGeometryInformation(GeometryInformation=gh_circlesection_6.图元信息)  # -> Brep, AnnotationGuideline, ReferencePlane, Description, BaseCurve
deconstructgeometryinformation_20 = DeconstructGeometryInformation(GeometryInformation=gh_circlesection_7.图元信息)  # -> Brep, AnnotationGuideline, ReferencePlane, Description, BaseCurve
垫板高宽权衡 = 垫板高宽权衡(柱径D=柱径)  # -> 金脊垫板尺寸, 檐垫板尺寸
deconstructsquareprofile_12 = DeconstructSquareProfile(SquareProfile=垫板高宽权衡.檐垫板尺寸, trueButton=0)  # -> Height, Width
deconstructsquareprofile_13 = DeconstructSquareProfile(SquareProfile=垫板高宽权衡.金脊垫板尺寸, trueButton=0)  # -> Height, Width
deconstructsquareprofile_14 = DeconstructSquareProfile(SquareProfile=垫板高宽权衡.金脊垫板尺寸, trueButton=0)  # -> Height, Width
deconstructsquareprofile_15 = DeconstructSquareProfile(SquareProfile=垫板高宽权衡.金脊垫板尺寸, trueButton=0)  # -> Height, Width
gh_rectanglesection_12 = GH_RectangleSection(
    定位基线=gh_circlesection_8.底部线,
    名称="下沉",
    上浮中心下沉="下沉",
    偏移=Slider(0, range=0..100),
    开端出头=Slider(0, range=0..1),
    尾端出头=Slider(0, range=0..1),
    高=deconstructsquareprofile_13.Height,
    宽=deconstructsquareprofile_13.Width,
    改动基准=False)  # -> 图元信息, 顶部线, 中部线, 底部线
gh_rectanglesection_13 = GH_RectangleSection(
    定位基线=gh_circlesection_9.底部线,
    名称="下沉",
    上浮中心下沉="下沉",
    偏移=Slider(0, range=0..100),
    开端出头=Slider(0, range=0..1),
    尾端出头=Slider(0, range=0..1),
    高=deconstructsquareprofile_14.Height,
    宽=deconstructsquareprofile_14.Width,
    改动基准=False)  # -> 图元信息, 顶部线, 中部线, 底部线
gh_rectanglesection_14 = GH_RectangleSection(
    定位基线=gh_circlesection_6.底部线,
    名称="下沉",
    上浮中心下沉="下沉",
    偏移=Slider(0, range=0..100),
    开端出头=Slider(0, range=0..1),
    尾端出头=Slider(0, range=0..1),
    高=deconstructsquareprofile_15.Height,
    宽=deconstructsquareprofile_15.Width,
    改动基准=False)  # -> 图元信息, 顶部线, 中部线, 底部线
gh_rectanglesection_15 = GH_RectangleSection(
    定位基线=gh_circlesection_7.底部线,
    名称="下沉",
    上浮中心下沉="下沉",
    偏移=Slider(0, range=0..100),
    开端出头=Slider(0, range=0..1),
    尾端出头=Slider(0, range=0..1),
    高=deconstructsquareprofile_12.Height,
    宽=deconstructsquareprofile_12.Width,
    改动基准=False)  # -> 图元信息, 顶部线, 中部线, 底部线
deconstructgeometryinformation_21 = DeconstructGeometryInformation(GeometryInformation=gh_rectanglesection_15.图元信息)  # -> Brep, AnnotationGuideline, ReferencePlane, Description, BaseCurve
deconstructgeometryinformation_22 = DeconstructGeometryInformation(GeometryInformation=gh_rectanglesection_12.图元信息)  # -> Brep, AnnotationGuideline, ReferencePlane, Description, BaseCurve
deconstructgeometryinformation_23 = DeconstructGeometryInformation(GeometryInformation=gh_rectanglesection_13.图元信息)  # -> Brep, AnnotationGuideline, ReferencePlane, Description, BaseCurve
deconstructgeometryinformation_24 = DeconstructGeometryInformation(GeometryInformation=gh_rectanglesection_14.图元信息)  # -> Brep, AnnotationGuideline, ReferencePlane, Description, BaseCurve
枋高宽权衡 = 枋高宽权衡(柱径D=柱径)  # -> 上金脊枋尺寸, 金枋尺寸, 檐枋尺寸, 穿插枋尺寸, 燕尾枋尺寸_配套檐垫板, 燕尾枋尺寸_配套脊垫板
deconstructsquareprofile_16 = DeconstructSquareProfile(SquareProfile=枋高宽权衡.檐枋尺寸, trueButton=0)  # -> Height, Width
deconstructsquareprofile_17 = DeconstructSquareProfile(SquareProfile=枋高宽权衡.金枋尺寸, trueButton=0)  # -> Height, Width
deconstructsquareprofile_18 = DeconstructSquareProfile(SquareProfile=枋高宽权衡.上金脊枋尺寸, trueButton=0)  # -> Height, Width
deconstructsquareprofile_19 = DeconstructSquareProfile(SquareProfile=枋高宽权衡.上金脊枋尺寸, trueButton=0)  # -> Height, Width
gh_rectanglesection_16 = GH_RectangleSection(
    定位基线=gh_rectanglesection_12.底部线,
    名称="下沉",
    上浮中心下沉="下沉",
    偏移=Slider(0, range=0..100),
    开端出头=Slider(0, range=0..1),
    尾端出头=Slider(0, range=0..1),
    高=deconstructsquareprofile_18.Height,
    宽=deconstructsquareprofile_18.Width,
    改动基准=False)  # -> 图元信息, 顶部线, 中部线, 底部线
gh_rectanglesection_17 = GH_RectangleSection(
    定位基线=gh_rectanglesection_13.底部线,
    名称="下沉",
    上浮中心下沉="下沉",
    偏移=Slider(0, range=0..100),
    开端出头=Slider(0, range=0..1),
    尾端出头=Slider(0, range=0..1),
    高=deconstructsquareprofile_19.Height,
    宽=deconstructsquareprofile_19.Width,
    改动基准=False)  # -> 图元信息, 顶部线, 中部线, 底部线
gh_rectanglesection_18 = GH_RectangleSection(
    定位基线=gh_rectanglesection_14.底部线,
    名称="下沉",
    上浮中心下沉="下沉",
    偏移=Slider(0, range=0..100),
    开端出头=Slider(0, range=0..1),
    尾端出头=Slider(0, range=0..1),
    高=deconstructsquareprofile_17.Height,
    宽=deconstructsquareprofile_17.Width,
    改动基准=False)  # -> 图元信息, 顶部线, 中部线, 底部线
gh_rectanglesection_19 = GH_RectangleSection(
    定位基线=gh_rectanglesection_15.底部线,
    名称="下沉",
    上浮中心下沉="下沉",
    偏移=Slider(0, range=0..100),
    开端出头=Slider(0, range=0..1),
    尾端出头=Slider(0, range=0..1),
    高=deconstructsquareprofile_16.Height,
    宽=deconstructsquareprofile_16.Width,
    改动基准=False)  # -> 图元信息, 顶部线, 中部线, 底部线
deconstructgeometryinformation_25 = DeconstructGeometryInformation(GeometryInformation=gh_rectanglesection_19.图元信息)  # -> Brep, AnnotationGuideline, ReferencePlane, Description, BaseCurve
deconstructgeometryinformation_26 = DeconstructGeometryInformation(GeometryInformation=gh_rectanglesection_16.图元信息)  # -> Brep, AnnotationGuideline, ReferencePlane, Description, BaseCurve
deconstructgeometryinformation_27 = DeconstructGeometryInformation(GeometryInformation=gh_rectanglesection_17.图元信息)  # -> Brep, AnnotationGuideline, ReferencePlane, Description, BaseCurve
deconstructgeometryinformation_28 = DeconstructGeometryInformation(GeometryInformation=gh_rectanglesection_18.图元信息)  # -> Brep, AnnotationGuideline, ReferencePlane, Description, BaseCurve
